# Grasshopper definition Brickworks_001.gh (Grasshopper 1.0.7)

# ---- group: brick_size
length = Slider(1, range=0..1)
width = Slider(0.5, range=0..1)
height = Slider(0.5, range=0..1)
merge = Merge(Data1=length, Data2=width, Data3=height)

# ---- group: center_machine
construct_point = ConstructPoint(XCoordinate=Slider(10, range=0..10), YCoordinate=Slider(10, range=0..10), ZCoordinate=0)

# ---- group: size_machine
merge_2 = Merge(Data1=Slider(5, range=0..10), Data2=Slider(6, range=0..10), Data3=Slider(2, range=0..10))

# ---- group: end_conveyor
construct_point_2 = ConstructPoint(XCoordinate=Slider(25, range=0..30), YCoordinate=Slider(15, range=0..20), ZCoordinate=0)

# ---- group: center_kiln
construct_point_3 = ConstructPoint(XCoordinate=Slider(35, range=0..40), YCoordinate=Slider(35, range=0..40), ZCoordinate=0)

# ---- group: size_kiln
length_2 = Slider(10, range=0..10)
height_2 = Slider(10, range=0..10)
width_2 = Slider(10, range=0..10)
merge_3 = Merge(Data1=length_2, Data2=width_2, Data3=height_2)

# ---- group: center_molding_machine
construct_point_4 = ConstructPoint(XCoordinate=Slider(50, range=0..50), YCoordinate=Slider(50, range=0..50), ZCoordinate=0)

# ---- group: size_molding_machine
width_3 = Slider(7, range=0..10)
height_3 = Slider(3, range=0..10)
length_3 = Slider(7, range=0..10)
merge_4 = Merge(Data1=length_3, Data2=width_3, Data3=height_3)

# ---- group: corner_drying_area
construct_point_5 = ConstructPoint(XCoordinate=Slider(70, range=0..100), YCoordinate=Slider(70, range=0..100), ZCoordinate=0)

# ---- group: size_drying_area
merge_5 = Merge(Data1=Slider(20, range=0..100), Data2=Slider(15, range=0..100))

# ---- group: end_wall
construct_point_6 = ConstructPoint(XCoordinate=Slider(100, range=0..100), YCoordinate=0, ZCoordinate=0)

# ---- group: start_conveyor
construct_point_7 = ConstructPoint(XCoordinate=Slider(15, range=0..20), YCoordinate=Slider(15, range=0..20), ZCoordinate=Slider(0, range=0..20))

# ----
height_conveyor = Slider(0.3, range=0..1)
width_conveyor = Slider(3.58, range=0..10)
height_wall = Slider(20, range=0..100)
gap = Slider(0.1, range=0..1)
# GPT IS MY COLLEGE,
# summer school 2023
# Learn Grasshopper for Rhino3d from Wickerson Studios
# URBAN ENGINEERING
# Infrastucture and Technology in Modern Landscape
# 
# CONVENIENTLY DOWNLOAD ALL REPOITORIES
# On Sale
# $9.99
# https://lnkd.in/gxAyuQ7W
# www.wickersonstudios.com
# 
# #technology #engineering #school
# BRICKWORKS
ghpython_script = GhPythonScript()  # -> out, a, b, c, d, e
# ---------- ghpython_script: Python ----------
__author__ = "Sculpture"
__version__ = "2023.06.30"

import rhinoscriptsyntax as rs

# Function to create a wall
def create_wall(start, end, height, brick_size, gap):
    bricks = []
    current_height = 0
    while current_height < height:
        current_point = start
        while rs.Distance(current_point, end) > brick_size[0]:
            brick = rs.AddBox([rs.PointAdd(current_point, [0, 0, current_height]),
                               rs.PointAdd(current_point, [brick_size[0], 0, current_height]),
                               rs.PointAdd(current_point, [brick_size[0], brick_size[1], current_height]),
                               rs.PointAdd(current_point, [0, brick_size[1], current_height]),
                               rs.PointAdd(current_point, [0, 0, current_height+brick_size[2]]),
                               rs.PointAdd(current_point, [brick_size[0], 0, current_height+brick_size[2]]),
                               rs.PointAdd(current_point, [brick_size[0], brick_size[1], current_height+brick_size[2]]),
                               rs.PointAdd(current_point, [0, brick_size[1], current_height+brick_size[2]])])
            bricks.append(brick)
            current_point = rs.PointAdd(current_point, [brick_size[0] + gap, 0, 0])
        current_height += brick_size[2] + gap
    return bricks

# Function to create machine-like rectangles
def create_machine(center, size):
    machine = rs.AddBox([rs.PointAdd(center, [-size[0]/2, -size[1]/2, 0]),
                         rs.PointAdd(center, [size[0]/2, -size[1]/2, 0]),
                         rs.PointAdd(center, [size[0]/2, size[1]/2, 0]),
                         rs.PointAdd(center, [-size[0]/2, size[1]/2, 0]),
                         rs.PointAdd(center, [-size[0]/2, -size[1]/2, size[2]]),
                         rs.PointAdd(center, [size[0]/2, -size[1]/2, size[2]]),
                         rs.PointAdd(center, [size[0]/2, size[1]/2, size[2]]),
                         rs.PointAdd(center, [-size[0]/2, size[1]/2, size[2]])])
    return machine

# Function to create conveyor belts
def create_conveyor(start, end, width, height):
    conveyor = rs.AddBox([rs.PointAdd(start, [-width/2, 0, 0]),
                          rs.PointAdd(start, [width/2, 0, 0]),
                          rs.PointAdd(end, [width/2, 0, 0]),
                          rs.PointAdd(end, [-width/2, 0, 0]),
                          rs.PointAdd(start, [-width/2, 0, height]),
                          rs.PointAdd(start, [width/2, 0, height]),
                          rs.PointAdd(end, [width/2, 0, height]),
                          rs.PointAdd(end, [-width/2, 0, height])])
    return conveyor

# Create walls
walls1 = create_wall([0,0,0], [100,0,0], 20, [5, 1, 3], 0.5)
walls2 = create_wall([0,20,0], [100,20,0], 20, [5, 1, 3], 0.5)

# Create machines
machine1 = create_machine([25,10,0], [10,10,10])
machine2 = create_machine([75,10,0], [10,10,10])

# Create conveyor belts
conveyor = create_conveyor([10,10,0], [90,10,0], 2, 0.5)

# Assign outputs
a = walls1
b = walls2
c = machine1
d = machine2
e = conveyor
# ---------- end ghpython_script ----------
brickworks_factory = GhPythonScript()  # -> out, a, b, c, d, e, f, g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
# ---------- brickworks_factory: Python ----------
__author__ = "Sculpture"
__version__ = "2023.06.30"

import rhinoscriptsyntax as rs

# Function to create a wall
def create_wall(start, end, height, brick_size, gap):
    bricks = []
    current_height = 0
    while current_height < height:
        current_point = start
        while rs.Distance(current_point, end) > brick_size[0]:
            brick = rs.AddBox([rs.PointAdd(current_point, [0, 0, current_height]),
                               rs.PointAdd(current_point, [brick_size[0], 0, current_height]),
                               rs.PointAdd(current_point, [brick_size[0], brick_size[1], current_height]),
                               rs.PointAdd(current_point, [0, brick_size[1], current_height]),
                               rs.PointAdd(current_point, [0, 0, current_height+brick_size[2]]),
                               rs.PointAdd(current_point, [brick_size[0], 0, current_height+brick_size[2]]),
                               rs.PointAdd(current_point, [brick_size[0], brick_size[1], current_height+brick_size[2]]),
                               rs.PointAdd(current_point, [0, brick_size[1], current_height+brick_size[2]])])
            bricks.append(brick)
            current_point = rs.PointAdd(current_point, [brick_size[0] + gap, 0, 0])
        current_height += brick_size[2] + gap
    return bricks

# Function to create machine-like rectangles
def create_machine(center, size):
    machine = rs.AddBox([rs.PointAdd(center, [-size[0]/2, -size[1]/2, 0]),
                         rs.PointAdd(center, [size[0]/2, -size[1]/2, 0]),
                         rs.PointAdd(center, [size[0]/2, size[1]/2, 0]),
                         rs.PointAdd(center, [-size[0]/2, size[1]/2, 0]),
                         rs.PointAdd(center, [-size[0]/2, -size[1]/2, size[2]]),
                         rs.PointAdd(center, [size[0]/2, -size[1]/2, size[2]]),
                         rs.PointAdd(center, [size[0]/2, size[1]/2, size[2]]),
                         rs.PointAdd(center, [-size[0]/2, size[1]/2, size[2]])])
    return machine

# Function to create conveyor belts
def create_conveyor(start, end, width, height):
    conveyor = rs.AddBox([rs.PointAdd(start, [-width/2, 0, 0]),
                          rs.PointAdd(start, [width/2, 0, 0]),
                          rs.PointAdd(end, [width/2, 0, 0]),
                          rs.PointAdd(end, [-width/2, 0, 0]),
                          rs.PointAdd(start, [-width/2, 0, height]),
                          rs.PointAdd(start, [width/2, 0, height]),
                          rs.PointAdd(end, [width/2, 0, height]),
                          rs.PointAdd(end, [-width/2, 0, height])])
    return conveyor

# Create walls
walls1 = create_wall([0,0,0], [100,0,0], 20, [5, 1, 3], 0.5)
walls2 = create_wall([0,20,0], [100,20,0], 20, [5, 1, 3], 0.5)

# Create machines
machine1 = create_machine([25,10,0], [10,10,10])
machine2 = create_machine([75,10,0], [10,10,10])

# Create conveyor belts
conveyor = create_conveyor([10,10,0], [90,10,0], 2, 0.5)

# Function to create a simple kiln model
def create_kiln(center, size):
    kiln = rs.AddCylinder(rs.PointAdd(center, [0,0,size[2]/2]), size[2]/2, size[2])
    return kiln

# Function to create a simple molding machine model
def create_molding_machine(center, size):
    machine = rs.AddBox([rs.PointAdd(center, [-size[0]/2, -size[1]/2, 0]),
                         rs.PointAdd(center, [size[0]/2, -size[1]/2, 0]),
                         rs.PointAdd(center, [size[0]/2, size[1]/2, 0]),
                         rs.PointAdd(center, [-size[0]/2, size[1]/2, 0]),
                         rs.PointAdd(center, [-size[0]/2, -size[1]/2, size[2]]),
                         rs.PointAdd(center, [size[0]/2, -size[1]/2, size[2]]),
                         rs.PointAdd(center, [size[0]/2, size[1]/2, size[2]]),
                         rs.PointAdd(center, [-size[0]/2, size[1]/2, size[2]])])
    return machine

# Function to create a simple drying area model
def create_drying_area(corner, size):
    area = rs.AddRectangle(rs.Plane.WorldXY, size[0], size[1])
    return area

# Create kiln
kiln = create_kiln([50,10,10], [20,20,20])

# Create molding machines
molding_machine1 = create_molding_machine([30,10,5], [10,10,10])
molding_machine2 = create_molding_machine([70,10,5], [10,10,10])

# Function to create a simple drying area model
def create_drying_area(corner, size):
    plane = rs.PlaneFromNormal(corner, [0,0,1])
    area = rs.AddRectangle(plane, size[0], size[1])
    return area

# Create drying areas
drying_area1 = create_drying_area([10,30,0], [30,20])
drying_area2 = create_drying_area([60,30,0], [30,20])


# Assign outputs
a = walls1
b = walls2
c = machine1
d = machine2
e = conveyor
# Assign outputs
f = kiln
g = molding_machine1
h = molding_machine2
i = drying_area1
j = drying_area2
# ---------- end brickworks_factory ----------

# ---- group: start_wall
construct_point_8 = ConstructPoint(XCoordinate=0, YCoordinate=0, ZCoordinate=0)

# ----
geometry = Geometry(ghpython_script.a)
geometry_2 = Geometry(ghpython_script.b)
geometry_3 = Geometry(ghpython_script.c)
geometry_4 = Geometry(ghpython_script.d)
geometry_5 = Geometry(ghpython_script.e)
geometry_6 = Geometry(brickworks_factory.a)
geometry_7 = Geometry(brickworks_factory.b)
geometry_8 = Geometry(brickworks_factory.c)
geometry_9 = Geometry(brickworks_factory.d)
geometry_10 = Geometry(brickworks_factory.e)
panel = Panel(ghpython_script.out)
panel_2 = Panel(brickworks_factory.out)
geometry_11 = Geometry(brickworks_factory.f)
geometry_12 = Geometry(brickworks_factory.g)
geometry_13 = Geometry(brickworks_factory.h)
geometry_14 = Geometry(brickworks_factory.i)
geometry_15 = Geometry(brickworks_factory.j)
brickworks_factory_2 = GhPythonScript(
    x=construct_point_8,
    y=construct_point_6,
    z=height_wall,
    a=merge,
    b=gap,
    c=construct_point,
    d=merge_2,
    e=construct_point_7,
    f=construct_point_2,
    g=width_conveyor,
    h=height_conveyor,
    i=construct_point_3,
    j=merge_3,
    k=construct_point_4,
    l=merge_4,
    m=construct_point_5,
    n=merge_5)  # -> out, a, b, c, d, e, f; inputs x: Point3d, y: Point3d, z: Int32, a: list, c: Point3d, d: list, e: Point3d, f: Point3d, i: Point3d, j: list of Int32, k: Point3d, l: list of Int32, m: Point3d, n: list
# ---------- brickworks_factory_2: Python ----------
__author__ = "Sculpture"
__version__ = "2023.06.30"

import rhinoscriptsyntax as rs

def create_wall(start, end, height, brick_size, gap):
    bricks = []
    current_height = 0
    while current_height < height:
        current_point = start
        while rs.Distance(current_point, end) > brick_size[0]:
            brick = rs.AddBox([rs.PointAdd(current_point, [0, 0, current_height]),
                               rs.PointAdd(current_point, [brick_size[0], 0, current_height]),
                               rs.PointAdd(current_point, [brick_size[0], brick_size[1], current_height]),
                               rs.PointAdd(current_point, [0, brick_size[1], current_height]),
                               rs.PointAdd(current_point, [0, 0, current_height+brick_size[2]]),
                               rs.PointAdd(current_point, [brick_size[0], 0, current_height+brick_size[2]]),
                               rs.PointAdd(current_point, [brick_size[0], brick_size[1], current_height+brick_size[2]]),
                               rs.PointAdd(current_point, [0, brick_size[1], current_height+brick_size[2]])])
            bricks.append(brick)
            current_point = rs.PointAdd(current_point, [brick_size[0] + gap, 0, 0])
        current_height += brick_size[2] + gap
    return bricks

def create_machine(center, size):
    machine = rs.AddBox([rs.PointAdd(center, [-size[0]/2, -size[1]/2, 0]),
                         rs.PointAdd(center, [size[0]/2, -size[1]/2, 0]),
                         rs.PointAdd(center, [size[0]/2, size[1]/2, 0]),
                         rs.PointAdd(center, [-size[0]/2, size[1]/2, 0]),
                         rs.PointAdd(center, [-size[0]/2, -size[1]/2, size[2]]),
                         rs.PointAdd(center, [size[0]/2, -size[1]/2, size[2]]),
                         rs.PointAdd(center, [size[0]/2, size[1]/2, size[2]]),
                         rs.PointAdd(center, [-size[0]/2, size[1]/2, size[2]])])
    return machine

def create_conveyor(start, end, width, height):
    conveyor = rs.AddBox([rs.PointAdd(start, [-width/2, 0, 0]),
                          rs.PointAdd(start, [width/2, 0, 0]),
                          rs.PointAdd(end, [width/2, 0, 0]),
                          rs.PointAdd(end, [-width/2, 0, 0]),
                          rs.PointAdd(start, [-width/2, 0, height]),
                          rs.PointAdd(start, [width/2, 0, height]),
                          rs.PointAdd(end, [width/2, 0, height]),
                          rs.PointAdd(end, [-width/2, 0, height])])
    return conveyor

def create_kiln(center, size):
    kiln = rs.AddCylinder(rs.PointAdd(center, [0,0,size[2]/2]), size[2]/2, size[2])
    return kiln

def create_molding_machine(center, size):
    machine = rs.AddBox([rs.PointAdd(center, [-size[0]/2, -size[1]/2, 0]),
                         rs.PointAdd(center, [size[0]/2, -size[1]/2, 0]),
                         rs.PointAdd(center, [size[0]/2, size[1]/2, 0]),
                         rs.PointAdd(center, [-size[0]/2, size[1]/2, 0]),
                         rs.PointAdd(center, [-size[0]/2, -size[1]/2, size[2]]),
                         rs.PointAdd(center, [size[0]/2, -size[1]/2, size[2]]),
                         rs.PointAdd(center, [size[0]/2, size[1]/2, size[2]]),
                         rs.PointAdd(center, [-size[0]/2, size[1]/2, size[2]])])
    return machine

def create_drying_area(corner, size):
    plane = rs.PlaneFromNormal(corner, [0,0,1])
    area = rs.AddRectangle(plane, size[0], size[1])
    return area

# Inputs from Grasshopper interface
start_wall = x  # Input from Grasshopper
end_wall = y  # Input from Grasshopper
height_wall = z  # Input from Grasshopper
brick_size = a  # Input from Grasshopper
gap = b  # Input from Grasshopper

center_machine = c  # Input from Grasshopper
size_machine = d  # Input from Grasshopper

start_conveyor = e  # Input from Grasshopper
end_conveyor = f  # Input from Grasshopper
width_conveyor = g  # Input from Grasshopper
height_conveyor = h  # Input from Grasshopper

center_kiln = i  # Input from Grasshopper
size_kiln = j  # Input from Grasshopper

center_molding_machine = k  # Input from Grasshopper
size_molding_machine = l  # Input from Grasshopper

corner_drying_area = m  # Input from Grasshopper
size_drying_area = n  # Input from Grasshopper

# Call the functions with the parameters
walls = create_wall(start_wall, end_wall, height_wall, brick_size, gap)
machines = create_machine(center_machine, size_machine)
conveyor = create_conveyor(start_conveyor, end_conveyor, width_conveyor, height_conveyor)
kiln = create_kiln(center_kiln, size_kiln)
molding_machine = create_molding_machine(center_molding_machine, size_molding_machine)
drying_area = create_drying_area(corner_drying_area, size_drying_area)

# Assign outputs for Grasshopper
a = walls
b = machines
c = conveyor
d = kiln
e = molding_machine
f = drying_area
# ---------- end brickworks_factory_2 ----------
geometry_16 = Geometry(brickworks_factory_2.a)
geometry_17 = Geometry(brickworks_factory_2.b)
geometry_18 = Geometry(brickworks_factory_2.e)
geometry_19 = Geometry(brickworks_factory_2.c)
geometry_20 = Geometry(brickworks_factory_2.d)
geometry_21 = Geometry(brickworks_factory_2.f)
panel_3 = Panel(brickworks_factory_2.out)
