# Grasshopper definition Open_Pit_Mine_001.gh (Grasshopper 1.0.7)

# GPT IS MY COLLEGE,
# summer school 2023
# Learn Grasshopper for Rhino3d from Wickerson Studios
# URBAN ENGINEERING
# Infrastucture and Technology in Modern Landscape
# 
# CONVENIENTLY DOWNLOAD ALL REPOITORIES
# On Sale
# $9.99
# https://lnkd.in/gxAyuQ7W
# www.wickersonstudios.com
# 
# #technology #engineering #school
# OPEN PIT MINE
number_slider = Slider(12, range=0..100)

construct_point = ConstructPoint(XCoordinate=0, YCoordinate=0, ZCoordinate=0)
open_pit_mine = GhPythonScript(
    x=Slider(61.882, range=0..100),
    y=Slider(-12.85, range=-100..100),
    z=Slider(3, range=0..10),
    a=construct_point,
    d=Slider(-8.473, range=-10..10))  # -> out, a; inputs z: Int32, a: Point3d
# ---------- open_pit_mine: Python ----------
__author__ = "Sculpture"
__version__ = "2023.06.28"

import Rhino.Geometry as rg
import rhinoscriptsyntax as rs

# Inputs
radius = x  # Radius of the mine
depth = y  # Depth of the mine
steps = z  # Number of steps or terraces
center_point_input = a  # Position of the mine
offset_distance = d  # Offset distance for creating steps

# Generate mine
def generate_mine(radius, depth, steps, center_point_input, offset_distance):
    # list to hold all terraces
    terraces = []
    
    # calculate depth of each step
    step_depth = depth/steps
    
    # Convert the input into a valid 3D point
    center_point = rs.coerce3dpoint(center_point_input)
    if center_point is None:
        center_point = rg.Point3d(0, 0, 0)  # default to origin if input is invalid

    # calculate the smallest radius
    smallest_radius = radius/steps
    
    # ensure offset_distance is smaller than the smallest radius
    if offset_distance >= smallest_radius:
        print("Offset distance is too large, reducing it to half the smallest radius")
        offset_distance = smallest_radius / 2
    
    for i in range(steps):
        # calculate current step's radius
        curr_radius = radius*(i+1)/steps
        
        # calculate current step's depth
        curr_depth = step_depth*i
        
        # create a plane at the current depth
        curr_plane = rg.Plane(center_point + rg.Vector3d.ZAxis*(-curr_depth), rg.Vector3d.ZAxis)
        
        # create a circle at the current plane with the current radius
        curr_circle = rg.Circle(curr_plane, curr_radius)
        
        # create offset curve
        offset_curves = curr_circle.ToNurbsCurve().Offset(rg.Plane.WorldXY, -offset_distance, rs.UnitAbsoluteTolerance(), rg.CurveOffsetCornerStyle.Sharp)
        
        # check if the offset operation was successful
        if offset_curves is None:
            print("Failed to offset curve at step {}".format(i))
        else:
            # add the circle and offset curve to the terraces list as separate elements
            terraces.append(curr_circle.ToNurbsCurve())
            terraces.append(offset_curves[0])
    
    return terraces

mine = generate_mine(radius, depth, steps, center_point_input, offset_distance)

# Outputs
a = mine
# ---------- end open_pit_mine ----------
panel = Panel(open_pit_mine.out)
geometry = Geometry(open_pit_mine.a)
loft = Loft(Curves=geometry, Options={Adjust=False, Closed=False, LoftEnds=0, LoftSimp=0, LoftType=0, Rebuild=10, Refit=0.01})

construct_point_2 = ConstructPoint(XCoordinate=0, YCoordinate=0, ZCoordinate=0)
construct_point_3 = ConstructPoint(XCoordinate=0, YCoordinate=0, ZCoordinate=0)
construct_point_4 = ConstructPoint(XCoordinate=0, YCoordinate=0, ZCoordinate=0)
construct_point_5 = ConstructPoint(XCoordinate=0, YCoordinate=0, ZCoordinate=0)
construct_point_6 = ConstructPoint(XCoordinate=0, YCoordinate=0, ZCoordinate=0)
ghpython_script = GhPythonScript(x=number_slider, y=Slider(12, range=0..100), z=Slider(3, range=0..10))  # -> out, a; inputs z: Int32
# ---------- ghpython_script: Python ----------
__author__ = "Sculpture"
__version__ = "2023.06.28"

import Rhino.Geometry as rg
import rhinoscriptsyntax as rs

# Inputs
radius = x  # Radius of the mine
depth = y  # Depth of the mine
steps = z  # Number of steps or terraces
center_point = rs.coerce3dpoint(a)  # Position of the mine

# Generate mine
def generate_mine(radius, depth, steps, center_point):
    # list to hold all terraces
    terraces = []
    
    # calculate depth of each step
    step_depth = depth/steps
    
    for i in range(steps):
        # calculate current step's radius
        curr_radius = radius*(i+1)/steps
        
        # calculate current step's depth
        curr_depth = step_depth*i
        
        # create a plane at the current depth
        curr_plane = rg.Plane(center_point + rg.Vector3d.ZAxis*(-curr_depth), rg.Vector3d.ZAxis)
        
        # create a circle at the current plane with the current radius
        curr_circle = rg.Circle(curr_plane, curr_radius)
        
        # add the circle to the terraces list
        terraces.append(curr_circle.ToNurbsCurve())
    
    return terraces

mine = generate_mine(radius, depth, steps, center_point)

# Outputs
a = mine
# ---------- end ghpython_script ----------
open_pit_mine_2 = GhPythonScript(x=Slider(12, range=0..100), y=Slider(-7.44, range=-100..100), z=Slider(3, range=0..10), a=construct_point_2)  # -> out, a; inputs z: Int32, a: Point3d; same code as ghpython_script
open_pit_mine_3 = GhPythonScript(
    x=Slider(12, range=0..100),
    y=Slider(-7.44, range=-100..100),
    z=Slider(3, range=0..10),
    a=construct_point_3,
    d=Slider(4.631, range=0..100))  # -> out, a; inputs z: Int32, a: Point3d
# ---------- open_pit_mine_3: Python ----------
__author__ = "Sculpture"
__version__ = "2023.06.28"

import Rhino.Geometry as rg
import rhinoscriptsyntax as rs

# Inputs
radius = x  # Radius of the mine
depth = y  # Depth of the mine
steps = z  # Number of steps or terraces
center_point_input = a  # Position of the mine
offset_distance = d  # Offset distance for creating steps

# Generate mine
def generate_mine(radius, depth, steps, center_point_input, offset_distance):
    # list to hold all terraces
    terraces = []
    
    # calculate depth of each step
    step_depth = depth/steps
    
    # Convert the input into a valid 3D point
    center_point = rs.coerce3dpoint(center_point_input)
    if center_point is None:
        center_point = rg.Point3d(0, 0, 0)  # default to origin if input is invalid
    
    for i in range(steps):
        # calculate current step's radius
        curr_radius = radius*(i+1)/steps
        
        # calculate current step's depth
        curr_depth = step_depth*i
        
        # create a plane at the current depth
        curr_plane = rg.Plane(center_point + rg.Vector3d.ZAxis*(-curr_depth), rg.Vector3d.ZAxis)
        
        # create a circle at the current plane with the current radius
        curr_circle = rg.Circle(curr_plane, curr_radius)
        
        # create offset curve
        offset_curve = curr_circle.ToNurbsCurve().Offset(rg.Plane.WorldXY, -offset_distance, rs.UnitAbsoluteTolerance(), rg.CurveOffsetCornerStyle.Sharp)
        
        # add the circle and offset curve to the terraces list as a tuple
        terraces.append((curr_circle.ToNurbsCurve(), offset_curve[0]))
    
    return terraces

mine = generate_mine(radius, depth, steps, center_point_input, offset_distance)

# Outputs
a = mine
# ---------- end open_pit_mine_3 ----------
open_pit_mine_4 = GhPythonScript(
    x=Slider(12, range=0..100),
    y=Slider(-7.44, range=-100..100),
    z=Slider(3, range=0..10),
    a=construct_point_4,
    d=Slider(4.631, range=0..100))  # -> out, a; inputs z: Int32, a: Point3d
# ---------- open_pit_mine_4: Python ----------
__author__ = "Sculpture"
__version__ = "2023.06.28"

import Rhino.Geometry as rg
import rhinoscriptsyntax as rs

# Inputs
radius = x  # Radius of the mine
depth = y  # Depth of the mine
steps = z  # Number of steps or terraces
center_point_input = a  # Position of the mine
offset_distance = d  # Offset distance for creating steps

# Generate mine
def generate_mine(radius, depth, steps, center_point_input, offset_distance):
    # list to hold all terraces
    terraces = []
    
    # calculate depth of each step
    step_depth = depth/steps
    
    # Convert the input into a valid 3D point
    center_point = rs.coerce3dpoint(center_point_input)
    if center_point is None:
        center_point = rg.Point3d(0, 0, 0)  # default to origin if input is invalid
    
    for i in range(steps):
        # calculate current step's radius
        curr_radius = radius*(i+1)/steps
        
        # calculate current step's depth
        curr_depth = step_depth*i
        
        # create a plane at the current depth
        curr_plane = rg.Plane(center_point + rg.Vector3d.ZAxis*(-curr_depth), rg.Vector3d.ZAxis)
        
        # create a circle at the current plane with the current radius
        curr_circle = rg.Circle(curr_plane, curr_radius)
        
        # create offset curve
        offset_curves = curr_circle.ToNurbsCurve().Offset(rg.Plane.WorldXY, -offset_distance, rs.UnitAbsoluteTolerance(), rg.CurveOffsetCornerStyle.Sharp)
        
        # check if the offset operation was successful
        if offset_curves is None:
            print("Failed to offset curve at step {}".format(i))
        else:
            # add the circle and offset curve to the terraces list as a tuple
            terraces.append((curr_circle.ToNurbsCurve(), offset_curves[0]))
    
    return terraces

mine = generate_mine(radius, depth, steps, center_point_input, offset_distance)

# Outputs
a = mine
# ---------- end open_pit_mine_4 ----------
open_pit_mine_5 = GhPythonScript(
    x=Slider(61.882, range=0..100),
    y=Slider(3.854, range=-100..100),
    z=Slider(3, range=0..10),
    a=construct_point_5,
    d=Slider(8.47, range=0..100))  # -> out, a; inputs z: Int32, a: Point3d
# ---------- open_pit_mine_5: Python ----------
__author__ = "Sculpture"
__version__ = "2023.06.28"

import Rhino.Geometry as rg
import rhinoscriptsyntax as rs

# Inputs
radius = x  # Radius of the mine
depth = y  # Depth of the mine
steps = z  # Number of steps or terraces
center_point_input = a  # Position of the mine
offset_distance = d  # Offset distance for creating steps

# Generate mine
def generate_mine(radius, depth, steps, center_point_input, offset_distance):
    # list to hold all terraces
    terraces = []
    
    # calculate depth of each step
    step_depth = depth/steps
    
    # Convert the input into a valid 3D point
    center_point = rs.coerce3dpoint(center_point_input)
    if center_point is None:
        center_point = rg.Point3d(0, 0, 0)  # default to origin if input is invalid

    # calculate the smallest radius
    smallest_radius = radius/steps
    
    # ensure offset_distance is smaller than the smallest radius
    if offset_distance >= smallest_radius:
        print("Offset distance is too large, reducing it to half the smallest radius")
        offset_distance = smallest_radius / 2
    
    for i in range(steps):
        # calculate current step's radius
        curr_radius = radius*(i+1)/steps
        
        # calculate current step's depth
        curr_depth = step_depth*i
        
        # create a plane at the current depth
        curr_plane = rg.Plane(center_point + rg.Vector3d.ZAxis*(-curr_depth), rg.Vector3d.ZAxis)
        
        # create a circle at the current plane with the current radius
        curr_circle = rg.Circle(curr_plane, curr_radius)
        
        # create offset curve
        offset_curves = curr_circle.ToNurbsCurve().Offset(rg.Plane.WorldXY, -offset_distance, rs.UnitAbsoluteTolerance(), rg.CurveOffsetCornerStyle.Sharp)
        
        # check if the offset operation was successful
        if offset_curves is None:
            print("Failed to offset curve at step {}".format(i))
        else:
            # add the circle and offset curve to the terraces list as a tuple
            terraces.append((curr_circle.ToNurbsCurve(), offset_curves[0]))
    
    return terraces

mine = generate_mine(radius, depth, steps, center_point_input, offset_distance)

# Outputs
a = mine
# ---------- end open_pit_mine_5 ----------
open_pit_mine_6 = GhPythonScript(
    x=Slider(61.882, range=0..100),
    y=Slider(-12.85, range=-100..100),
    z=Slider(3, range=0..10),
    a=construct_point_6,
    d=Slider(-8.473, range=-10..10))  # -> out, a, s; inputs z: Int32, a: Point3d
# ---------- open_pit_mine_6: Python ----------
__author__ = "Sculpture"
__version__ = "2023.06.28"

import Rhino.Geometry as rg
import rhinoscriptsyntax as rs

# Inputs
radius = x  # Radius of the mine
depth = y  # Depth of the mine
steps = z  # Number of steps or terraces
center_point_input = a  # Position of the mine
offset_distance = d  # Offset distance for creating steps

# Generate mine
def generate_mine(radius, depth, steps, center_point_input, offset_distance):
    # list to hold all terraces
    terraces = []
    
    # list to hold lofted surfaces
    surfaces = []
    
    # calculate depth of each step
    step_depth = depth/steps
    
    # Convert the input into a valid 3D point
    center_point = rs.coerce3dpoint(center_point_input)
    if center_point is None:
        center_point = rg.Point3d(0, 0, 0)  # default to origin if input is invalid

    # calculate the smallest radius
    smallest_radius = radius/steps
    
    # ensure offset_distance is smaller than the smallest radius
    if offset_distance >= smallest_radius:
        print("Offset distance is too large, reducing it to half the smallest radius")
        offset_distance = smallest_radius / 2
    
    for i in range(steps):
        # calculate current step's radius
        curr_radius = radius*(i+1)/steps
        
        # calculate current step's depth
        curr_depth = step_depth*i
        
        # create a plane at the current depth
        curr_plane = rg.Plane(center_point + rg.Vector3d.ZAxis*(-curr_depth), rg.Vector3d.ZAxis)
        
        # create a circle at the current plane with the current radius
        curr_circle = rg.Circle(curr_plane, curr_radius)
        
        # create offset curve
        offset_curves = curr_circle.ToNurbsCurve().Offset(rg.Plane.WorldXY, -offset_distance, rs.UnitAbsoluteTolerance(), rg.CurveOffsetCornerStyle.Sharp)
        
        # check if the offset operation was successful
        if offset_curves is None:
            print("Failed to offset curve at step {}".format(i))
        else:
            # add the circle and offset curve to the terraces list as separate elements
            terraces.append(curr_circle.ToNurbsCurve())
            terraces.append(offset_curves[0])
            
            # if it's not the first step, loft the current and previous curves to create a surface
            if i > 0:
                prev_terrace = terraces[-3]  # get the previous terrace curve
                curr_terrace = terraces[-2]  # get the current terrace curve
                surface, lofted_surface = rg.Brep.CreateFromLoft([prev_terrace, curr_terrace], rg.Point3d.Unset, rg.Point3d.Unset, rg.LoftType.Normal, False)
                if lofted_surface:
                    surfaces.extend(lofted_surface)
    
    return terraces, surfaces

mine, surfaces = generate_mine(radius, depth, steps, center_point_input, offset_distance)

# Outputs
a = mine
s = surfaces
# ---------- end open_pit_mine_6 ----------
panel_2 = Panel(ghpython_script.out)
geometry_2 = Geometry(ghpython_script.a)
panel_3 = Panel(open_pit_mine_2.out)
geometry_3 = Geometry(open_pit_mine_2.a)
panel_4 = Panel(open_pit_mine_3.out)
geometry_4 = Geometry(open_pit_mine_3.a)
panel_5 = Panel(open_pit_mine_4.out)
geometry_5 = Geometry(open_pit_mine_4.a)
panel_6 = Panel(open_pit_mine_5.out)
panel_7 = Panel(open_pit_mine_6.out)
# output a data conversion failed from goo to geopmetry
geometry_6 = Geometry(open_pit_mine_5.a)
geometry_7 = Geometry(open_pit_mine_6.a)

construct_point_7 = ConstructPoint(XCoordinate=0, YCoordinate=0, ZCoordinate=0)
open_pit_mine_7 = GhPythonScript(
    x=Slider(65.64, range=0..100),
    y=Slider(-23.708, range=-100..100),
    z=Slider(4, range=0..10),
    a=construct_point_7,
    d=Slider(-10, range=-10..10))  # -> out, a, s, f; inputs z: Int32, a: Point3d
# ---------- open_pit_mine_7: Python ----------
__author__ = "Sculpture"
__version__ = "2023.06.28"

import Rhino.Geometry as rg
import rhinoscriptsyntax as rs

# Inputs
radius = x  # Radius of the mine
depth = y  # Depth of the mine
steps = z  # Number of steps or terraces
center_point_input = a  # Position of the mine
offset_distance = d  # Offset distance for creating steps

# Generate mine
def generate_mine(radius, depth, steps, center_point_input, offset_distance):
    # list to hold all terraces
    terraces = []
    
    # list to hold lofted surfaces
    surfaces = []
    
    # list to hold flat surfaces
    flat_surfaces = []
    
    # calculate depth of each step
    step_depth = depth/steps
    
    # Convert the input into a valid 3D point
    center_point = rs.coerce3dpoint(center_point_input)
    if center_point is None:
        center_point = rg.Point3d(0, 0, 0)  # default to origin if input is invalid

    # calculate the smallest radius
    smallest_radius = radius/steps
    
    # ensure offset_distance is smaller than the smallest radius
    if offset_distance >= smallest_radius:
        print("Offset distance is too large, reducing it to half the smallest radius")
        offset_distance = smallest_radius / 2
    
    for i in range(steps):
        # calculate current step's radius
        curr_radius = radius*(i+1)/steps
        
        # calculate current step's depth
        curr_depth = step_depth*i
        
        # create a plane at the current depth
        curr_plane = rg.Plane(center_point + rg.Vector3d.ZAxis*(-curr_depth), rg.Vector3d.ZAxis)
        
        # create a circle at the current plane with the current radius
        curr_circle = rg.Circle(curr_plane, curr_radius)
        
        # create offset curve
        offset_curves = curr_circle.ToNurbsCurve().Offset(rg.Plane.WorldXY, -offset_distance, rs.UnitAbsoluteTolerance(), rg.CurveOffsetCornerStyle.Sharp)
        
        # check if the offset operation was successful
        if offset_curves is None:
            print("Failed to offset curve at step {}".format(i))
        else:
            # add the circle and offset curve to the terraces list as separate elements
            terraces.append(curr_circle.ToNurbsCurve())
            terraces.append(offset_curves[0])
            
            # create planar surface between terrace and its offset curve
            loft_result = rg.Brep.CreateFromLoft([curr_circle.ToNurbsCurve(), offset_curves[0]], rg.Point3d.Unset, rg.Point3d.Unset, rg.LoftType.Normal, False)
            if loft_result is not None and len(loft_result) > 0:
                flat_surfaces.extend(loft_result)
            
            # if it's not the first step, loft the current and previous curves to create a surface
            if i > 0:
                prev_terrace = terraces[-3]  # get the previous terrace curve
                curr_terrace = terraces[-2]  # get the current terrace curve
                loft_results = rg.Brep.CreateFromLoft([prev_terrace, curr_terrace], rg.Point3d.Unset, rg.Point3d.Unset, rg.LoftType.Normal, False)
                if loft_results is not None and len(loft_results) > 0:
                    surfaces.extend(loft_results)
    
    return terraces, surfaces, flat_surfaces

mine, surfaces, flats = generate_mine(radius, depth, steps, center_point_input, offset_distance)

# Outputs
a = mine
s = surfaces
f = flats
# ---------- end open_pit_mine_7 ----------
panel_8 = Panel(open_pit_mine_7.out)
geometry_8 = Geometry(open_pit_mine_7.f)
geometry_9 = Geometry(open_pit_mine_7.a)
geometry_10 = Geometry(open_pit_mine_7.s)

construct_point_8 = ConstructPoint(XCoordinate=0, YCoordinate=0, ZCoordinate=0)
open_pit_mine_8 = GhPythonScript(
    x=Slider(39.052, range=0..100),
    y=Slider(-17.928, range=-100..100),
    z=Slider(3, range=0..10),
    a=construct_point_8,
    d=Slider(-4.914, range=-10..10),
    f=Slider(0.4202, range=0..1),
    p=Slider(125, range=0..125))  # -> out, a, s, f; inputs z: Int32, a: Point3d, p: Int32
# ---------- open_pit_mine_8: Python ----------
__author__ = "Sculpture"
__version__ = "2023.06.28"

import Rhino.Geometry as rg
import rhinoscriptsyntax as rs
import random
import math  # Add this line

# Inputs
radius = x  # Radius of the mine
depth = y  # Depth of the mine
steps = z  # Number of steps or terraces
center_point_input = a  # Position of the mine
offset_distance = d  # Offset distance for creating steps
noise_factor = f  # The amount of noise (random radial displacement)
point_count = p  # The number of points on the curve

# Generate mine
def generate_mine(radius, depth, steps, center_point_input, offset_distance, noise_factor, point_count):
    # list to hold all terraces
    terraces = []
    
    # list to hold lofted surfaces
    surfaces = []
    
    # list to hold flat surfaces
    flat_surfaces = []
    
    # calculate depth of each step
    step_depth = depth/steps
    
    # Convert the input into a valid 3D point
    center_point = rs.coerce3dpoint(center_point_input)
    if center_point is None:
        center_point = rg.Point3d(0, 0, 0)  # default to origin if input is invalid

    # calculate the smallest radius
    smallest_radius = radius/steps
    
    # ensure offset_distance is smaller than the smallest radius
    if offset_distance >= smallest_radius:
        print("Offset distance is too large, reducing it to half the smallest radius")
        offset_distance = smallest_radius / 2
    
    for i in range(steps):
        # calculate current step's radius
        curr_radius = radius*(i+1)/steps
        
        # calculate current step's depth
        curr_depth = step_depth*i
        
        # create a plane at the current depth
        curr_plane = rg.Plane(center_point + rg.Vector3d.ZAxis*(-curr_depth), rg.Vector3d.ZAxis)
        
        # create points on circle with noise
        angle_step = 2*3.1415926/(point_count-1)  # Subtract one to account for the closing point
        points = []
        for j in range(point_count):
            angle = j*angle_step
            noise = random.uniform(-noise_factor, noise_factor)
            point = rg.Point3d.Add(center_point, rg.Vector3d((curr_radius + noise)*math.cos(angle), (curr_radius + noise)*math.sin(angle), -curr_depth))
            points.append(point)
        points.append(points[0])  # Add the first point again to close the curve
        noisy_curve = rg.Curve.CreateInterpolatedCurve(points, 3)
        
        # create offset curve
        offset_curves = noisy_curve.Offset(rg.Plane.WorldXY, -offset_distance, rs.UnitAbsoluteTolerance(), rg.CurveOffsetCornerStyle.Sharp)
        
        # check if the offset operation was successful
        if offset_curves is None:
            print("Failed to offset curve at step {}".format(i))
        else:
            # add the curve and offset curve to the terraces list as separate elements
            terraces.append(noisy_curve)
            terraces.append(offset_curves[0])
            
            # create planar surface between terrace and its offset curve
            loft_result = rg.Brep.CreateFromLoft([noisy_curve, offset_curves[0]], rg.Point3d.Unset, rg.Point3d.Unset, rg.LoftType.Normal, False)
            if loft_result is not None and len(loft_result) > 0:
                flat_surfaces.extend(loft_result)
            
            # if it's not the first step, loft the current and previous curves to create a surface
            if i > 0:
                prev_terrace = terraces[-3]  # get the previous terrace curve
                curr_terrace = terraces[-2]  # get the current terrace curve
                loft_results = rg.Brep.CreateFromLoft([prev_terrace, curr_terrace], rg.Point3d.Unset, rg.Point3d.Unset, rg.LoftType.Normal, False)
                if loft_results is not None and len(loft_results) > 0:
                    surfaces.extend(loft_results)
    
    return terraces, surfaces, flat_surfaces

mine, surfaces, flats = generate_mine(radius, depth, steps, center_point_input, offset_distance, noise_factor, point_count)

# Outputs
a = mine
s = surfaces
f = flats
# ---------- end open_pit_mine_8 ----------
panel_9 = Panel(open_pit_mine_8.out)
geometry_11 = Geometry(open_pit_mine_8.f)
geometry_12 = Geometry(open_pit_mine_8.a)
geometry_13 = Geometry(open_pit_mine_8.s)

construct_point_9 = ConstructPoint(XCoordinate=0, YCoordinate=0, ZCoordinate=0)
construct_point_10 = ConstructPoint(XCoordinate=0, YCoordinate=0, ZCoordinate=0)
construct_point_11 = ConstructPoint(XCoordinate=0, YCoordinate=0, ZCoordinate=0)
construct_point_12 = ConstructPoint(XCoordinate=0, YCoordinate=0, ZCoordinate=0)
open_pit_mine_9 = GhPythonScript(
    x=Slider(26.336, range=0..100),
    y=Slider(-19.084, range=-100..100),
    z=Slider(4, range=0..10),
    a=construct_point_10,
    d=Slider(-3.758, range=-10..10),
    f=Slider(0.1947, range=0..1),
    p=Slider(4, range=0..5))  # -> out, a, s, f; inputs z: Int32, a: Point3d, p: Int32
# ---------- open_pit_mine_9: Python ----------
__author__ = "Sculpture"
__version__ = "2023.06.28"

import Rhino.Geometry as rg
import rhinoscriptsyntax as rs
import random

# Inputs
radius = x  # Radius of the mine
depth = y  # Depth of the mine
steps = z  # Number of steps or terraces
center_point_input = a  # Position of the mine
offset_distance = d  # Offset distance for creating steps
noise_factor = f  # The amount of noise (random radial displacement)

# Generate mine
def generate_mine(radius, depth, steps, center_point_input, offset_distance, noise_factor):
    # list to hold all terraces
    terraces = []
    
    # list to hold lofted surfaces
    surfaces = []
    
    # list to hold flat surfaces
    flat_surfaces = []
    
    # calculate depth of each step
    step_depth = depth/steps
    
    # Convert the input into a valid 3D point
    center_point = rs.coerce3dpoint(center_point_input)
    if center_point is None:
        center_point = rg.Point3d(0, 0, 0)  # default to origin if input is invalid

    # calculate the smallest radius
    smallest_radius = radius/steps
    
    # ensure offset_distance is smaller than the smallest radius
    if offset_distance >= smallest_radius:
        print("Offset distance is too large, reducing it to half the smallest radius")
        offset_distance = smallest_radius / 2
    
    # number of points on the curve
    point_count = p
    
    for i in range(steps):
        # calculate current step's radius
        curr_radius = radius*(i+1)/steps
        
        # calculate current step's depth
        curr_depth = step_depth*i
        
        # create a plane at the current depth
        curr_plane = rg.Plane(center_point + rg.Vector3d.ZAxis*(-curr_depth), rg.Vector3d.ZAxis)
        
        # create a circle at the current plane with the current radius
        curr_circle = rg.Circle(curr_plane, curr_radius)
        
        # create points on circle with noise
        angle_step = 2*3.1415926/point_count
        points = []
        for j in range(point_count):
            angle = j*angle_step
            noise = random.uniform(-noise_factor, noise_factor)
            point = rg.Point3d.Add(curr_circle.Center, rg.Vector3d(curr_circle.Radius + noise, angle, 0))
            points.append(point)
        noisy_curve = rg.Curve.CreateInterpolatedCurve(points, 3)
        
        # create offset curve
        offset_curves = noisy_curve.Offset(rg.Plane.WorldXY, -offset_distance, rs.UnitAbsoluteTolerance(), rg.CurveOffsetCornerStyle.Sharp)
        
        # check if the offset operation was successful
        if offset_curves is None:
            print("Failed to offset curve at step {}".format(i))
        else:
            # add the circle and offset curve to the terraces list as separate elements
            terraces.append(noisy_curve)
            terraces.append(offset_curves[0])
            
            # create planar surface between terrace and its offset curve
            loft_result = rg.Brep.CreateFromLoft([noisy_curve, offset_curves[0]], rg.Point3d.Unset, rg.Point3d.Unset, rg.LoftType.Normal, False)
            if loft_result is not None and len(loft_result) > 0:
                flat_surfaces.extend(loft_result)
            
            # if it's not the first step, loft the current and previous curves to create a surface
            if i > 0:
                prev_terrace = terraces[-3]  # get the previous terrace curve
                curr_terrace = terraces[-2]  # get the current terrace curve
                loft_results = rg.Brep.CreateFromLoft([prev_terrace, curr_terrace], rg.Point3d.Unset, rg.Point3d.Unset, rg.LoftType.Normal, False)
                if loft_results is not None and len(loft_results) > 0:
                    surfaces.extend(loft_results)
    
    return terraces, surfaces, flat_surfaces

mine, surfaces, flats = generate_mine(radius, depth, steps, center_point_input, offset_distance, noise_factor)

# Outputs
a = mine
s = surfaces
f = flats
# ---------- end open_pit_mine_9 ----------
open_pit_mine_10 = GhPythonScript(
    x=Slider(65.64, range=0..100),
    y=Slider(-23.708, range=-100..100),
    z=Slider(4, range=0..10),
    a=construct_point_9,
    d=Slider(-10, range=-10..10))  # -> out, a, s; inputs z: Int32, a: Point3d
# ---------- open_pit_mine_10: Python ----------
__author__ = "Sculpture"
__version__ = "2023.06.28"

import Rhino.Geometry as rg
import rhinoscriptsyntax as rs

# Inputs
radius = x  # Radius of the mine
depth = y  # Depth of the mine
steps = z  # Number of steps or terraces
center_point_input = a  # Position of the mine
offset_distance = d  # Offset distance for creating steps

# Generate mine
def generate_mine(radius, depth, steps, center_point_input, offset_distance):
    # list to hold all terraces
    terraces = []
    
    # list to hold lofted surfaces
    surfaces = []
    
    # calculate depth of each step
    step_depth = depth/steps
    
    # Convert the input into a valid 3D point
    center_point = rs.coerce3dpoint(center_point_input)
    if center_point is None:
        center_point = rg.Point3d(0, 0, 0)  # default to origin if input is invalid

    # calculate the smallest radius
    smallest_radius = radius/steps
    
    # ensure offset_distance is smaller than the smallest radius
    if offset_distance >= smallest_radius:
        print("Offset distance is too large, reducing it to half the smallest radius")
        offset_distance = smallest_radius / 2
    
    for i in range(steps):
        # calculate current step's radius
        curr_radius = radius*(i+1)/steps
        
        # calculate current step's depth
        curr_depth = step_depth*i
        
        # create a plane at the current depth
        curr_plane = rg.Plane(center_point + rg.Vector3d.ZAxis*(-curr_depth), rg.Vector3d.ZAxis)
        
        # create a circle at the current plane with the current radius
        curr_circle = rg.Circle(curr_plane, curr_radius)
        
        # create offset curve
        offset_curves = curr_circle.ToNurbsCurve().Offset(rg.Plane.WorldXY, -offset_distance, rs.UnitAbsoluteTolerance(), rg.CurveOffsetCornerStyle.Sharp)
        
        # check if the offset operation was successful
        if offset_curves is None:
            print("Failed to offset curve at step {}".format(i))
        else:
            # add the circle and offset curve to the terraces list as separate elements
            terraces.append(curr_circle.ToNurbsCurve())
            terraces.append(offset_curves[0])
            
            # if it's not the first step, loft the current and previous curves to create a surface
            if i > 0:
                prev_terrace = terraces[-3]  # get the previous terrace curve
                curr_terrace = terraces[-2]  # get the current terrace curve
                loft_results = rg.Brep.CreateFromLoft([prev_terrace, curr_terrace], rg.Point3d.Unset, rg.Point3d.Unset, rg.LoftType.Normal, False)
                if loft_results is not None and len(loft_results) > 0:
                    surfaces.extend(loft_results)
    
    return terraces, surfaces

mine, surfaces = generate_mine(radius, depth, steps, center_point_input, offset_distance)

# Outputs
a = mine
s = surfaces
# ---------- end open_pit_mine_10 ----------
open_pit_mine_11 = GhPythonScript(
    x=Slider(65.64, range=0..100),
    y=Slider(-23.708, range=-100..100),
    z=Slider(5, range=0..10),
    a=construct_point_11,
    d=Slider(-10, range=-10..10))  # -> out, a, s, f; inputs z: Int32, a: Point3d
# ---------- open_pit_mine_11: Python ----------
__author__ = "Sculpture"
__version__ = "2023.06.28"

import Rhino.Geometry as rg
import rhinoscriptsyntax as rs

# Inputs
radius = x  # Radius of the mine
depth = y  # Depth of the mine
steps = z  # Number of steps or terraces
center_point_input = a  # Position of the mine
offset_distance = d  # Offset distance for creating steps

# Generate mine
def generate_mine(radius, depth, steps, center_point_input, offset_distance):
    # list to hold all terraces
    terraces = []
    
    # list to hold lofted surfaces
    surfaces = []
    
    # list to hold flat surfaces
    flat_surfaces = []
    
    # calculate depth of each step
    step_depth = depth/steps
    
    # Convert the input into a valid 3D point
    center_point = rs.coerce3dpoint(center_point_input)
    if center_point is None:
        center_point = rg.Point3d(0, 0, 0)  # default to origin if input is invalid

    # calculate the smallest radius
    smallest_radius = radius/steps
    
    # ensure offset_distance is smaller than the smallest radius
    if offset_distance >= smallest_radius:
        print("Offset distance is too large, reducing it to half the smallest radius")
        offset_distance = smallest_radius / 2
    
    for i in range(steps):
        # calculate current step's radius
        curr_radius = radius*(i+1)/steps
        
        # calculate current step's depth
        curr_depth = step_depth*i
        
        # create a plane at the current depth
        curr_plane = rg.Plane(center_point + rg.Vector3d.ZAxis*(-curr_depth), rg.Vector3d.ZAxis)
        
        # create a circle at the current plane with the current radius
        curr_circle = rg.Circle(curr_plane, curr_radius)
        
        # create offset curve
        offset_curves = curr_circle.ToNurbsCurve().Offset(rg.Plane.WorldXY, -offset_distance, rs.UnitAbsoluteTolerance(), rg.CurveOffsetCornerStyle.Sharp)
        
        # check if the offset operation was successful
        if offset_curves is None:
            print("Failed to offset curve at step {}".format(i))
        else:
            # add the circle and offset curve to the terraces list as separate elements
            terraces.append(curr_circle.ToNurbsCurve())
            terraces.append(offset_curves[0])
            
            # create planar surface from offset curve
            offset_surface = rg.Brep.CreatePlanarBreps(offset_curves)
            if offset_surface:
                flat_surfaces.extend(offset_surface)
            
            # if it's not the first step, loft the current and previous curves to create a surface
            if i > 0:
                prev_terrace = terraces[-3]  # get the previous terrace curve
                curr_terrace = terraces[-2]  # get the current terrace curve
                loft_results = rg.Brep.CreateFromLoft([prev_terrace, curr_terrace], rg.Point3d.Unset, rg.Point3d.Unset, rg.LoftType.Normal, False)
                if loft_results is not None and len(loft_results) > 0:
                    surfaces.extend(loft_results)
    
    return terraces, surfaces, flat_surfaces

mine, surfaces, flats = generate_mine(radius, depth, steps, center_point_input, offset_distance)

# Outputs
a = mine
s = surfaces
f = flats
# ---------- end open_pit_mine_11 ----------
open_pit_mine_12 = GhPythonScript(
    x=Slider(26.336, range=0..100),
    y=Slider(-19.084, range=-100..100),
    z=Slider(4, range=0..10),
    a=construct_point_12,
    d=Slider(-3.758, range=-10..10),
    f=Slider(0.1947, range=0..1),
    p=Slider(4, range=0..5))  # -> out, a, s, f; inputs z: Int32, a: Point3d, p: Int32
# ---------- open_pit_mine_12: Python ----------
__author__ = "Sculpture"
__version__ = "2023.06.28"

import Rhino.Geometry as rg
import rhinoscriptsyntax as rs
import random

# Inputs
radius = x  # Radius of the mine
depth = y  # Depth of the mine
steps = z  # Number of steps or terraces
center_point_input = a  # Position of the mine
offset_distance = d  # Offset distance for creating steps
noise_factor = f  # The amount of noise (random radial displacement)
point_count = p  # The number of points on the curve

# Generate mine
def generate_mine(radius, depth, steps, center_point_input, offset_distance, noise_factor, point_count):
    # list to hold all terraces
    terraces = []
    
    # list to hold lofted surfaces
    surfaces = []
    
    # list to hold flat surfaces
    flat_surfaces = []
    
    # calculate depth of each step
    step_depth = depth/steps
    
    # Convert the input into a valid 3D point
    center_point = rs.coerce3dpoint(center_point_input)
    if center_point is None:
        center_point = rg.Point3d(0, 0, 0)  # default to origin if input is invalid

    # calculate the smallest radius
    smallest_radius = radius/steps
    
    # ensure offset_distance is smaller than the smallest radius
    if offset_distance >= smallest_radius:
        print("Offset distance is too large, reducing it to half the smallest radius")
        offset_distance = smallest_radius / 2
    
    for i in range(steps):
        # calculate current step's radius
        curr_radius = radius*(i+1)/steps
        
        # calculate current step's depth
        curr_depth = step_depth*i
        
        # create a plane at the current depth
        curr_plane = rg.Plane(center_point + rg.Vector3d.ZAxis*(-curr_depth), rg.Vector3d.ZAxis)
        
        # create points on circle with noise
        angle_step = 2*3.1415926/(point_count-1)  # Substract one to account for the closing point
        points = []
        for j in range(point_count):
            angle = j*angle_step
            noise = random.uniform(-noise_factor, noise_factor)
            point = rg.Point3d.Add(center_point, rg.Vector3d((curr_radius + noise)*math.cos(angle), (curr_radius + noise)*math.sin(angle), -curr_depth))
            points.append(point)
        points.append(points[0])  # Add the first point again to close the curve
        noisy_curve = rg.Curve.CreateInterpolatedCurve(points, 3)
        
        # create offset curve
        offset_curves = noisy_curve.Offset(rg.Plane.WorldXY, -offset_distance, rs.UnitAbsoluteTolerance(), rg.CurveOffsetCornerStyle.Sharp)
        
        # check if the offset operation was successful
        if offset_curves is None:
            print("Failed to offset curve at step {}".format(i))
        else:
            # add the curve and offset curve to the terraces list as separate elements
            terraces.append(noisy_curve)
            terraces.append(offset_curves[0])
            
            # create planar surface between terrace and its offset curve
            loft_result = rg.Brep.CreateFromLoft([noisy_curve, offset_curves[0]], rg.Point3d.Unset, rg.Point3d.Unset, rg.LoftType.Normal, False)
            if loft_result is not None and len(loft_result) > 0:
                flat_surfaces.extend(loft_result)
            
            # if it's not the first step, loft the current and previous curves to create a surface
            if i > 0:
                prev_terrace = terraces[-3]  # get the previous terrace curve
                curr_terrace = terraces[-2]  # get the current terrace curve
                loft_results = rg.Brep.CreateFromLoft([prev_terrace, curr_terrace], rg.Point3d.Unset, rg.Point3d.Unset, rg.LoftType.Normal, False)
                if loft_results is not None and len(loft_results) > 0:
                    surfaces.extend(loft_results)
    
    return terraces, surfaces, flat_surfaces

mine, surfaces, flats = generate_mine(radius, depth, steps, center_point_input, offset_distance, noise_factor, point_count)

# Outputs
a = mine
s = surfaces
f = flats
# ---------- end open_pit_mine_12 ----------
panel_10 = Panel(open_pit_mine_9.out)
panel_11 = Panel(open_pit_mine_10.out)
panel_12 = Panel(open_pit_mine_11.out)
geometry_14 = Geometry(open_pit_mine_9.f)
geometry_15 = Geometry(open_pit_mine_9.a)
geometry_16 = Geometry(open_pit_mine_9.s)
geometry_17 = Geometry(open_pit_mine_10.a)
geometry_18 = Geometry(open_pit_mine_10.s)
geometry_19 = Geometry(open_pit_mine_11.f)
geometry_20 = Geometry(open_pit_mine_11.a)
geometry_21 = Geometry(open_pit_mine_11.s)
panel_13 = Panel(open_pit_mine_12.out)
geometry_22 = Geometry(open_pit_mine_12.f)
geometry_23 = Geometry(open_pit_mine_12.a)
geometry_24 = Geometry(open_pit_mine_12.s)
