# Grasshopper definition Open_Pit_Mine_002.gh (Grasshopper 1.0.7)

construct_point = ConstructPoint(XCoordinate=0, YCoordinate=0, ZCoordinate=0)
open_pit_mine = GhPythonScript(
    x=Slider(56.305, range=0..100),
    y=Slider(-21.743, range=-100..100),
    z=Slider(4, range=0..10),
    a=construct_point,
    d=Slider(-9.607, range=-10..10))  # -> out, a, s, f; inputs z: Int32, a: Point3d
# ---------- open_pit_mine: Python ----------
__author__ = "Sculpture"
__version__ = "2023.06.28"

import Rhino.Geometry as rg
import rhinoscriptsyntax as rs

# Inputs
radius = x  # Radius of the mine
depth = y  # Depth of the mine
steps = z  # Number of steps or terraces
center_point_input = a  # Position of the mine
offset_distance = d  # Offset distance for creating steps

# Generate mine
def generate_mine(radius, depth, steps, center_point_input, offset_distance):
    # list to hold all terraces
    terraces = []
    
    # list to hold lofted surfaces
    surfaces = []
    
    # list to hold flat surfaces
    flat_surfaces = []
    
    # calculate depth of each step
    step_depth = depth/steps
    
    # Convert the input into a valid 3D point
    center_point = rs.coerce3dpoint(center_point_input)
    if center_point is None:
        center_point = rg.Point3d(0, 0, 0)  # default to origin if input is invalid

    # calculate the smallest radius
    smallest_radius = radius/steps
    
    # ensure offset_distance is smaller than the smallest radius
    if offset_distance >= smallest_radius:
        print("Offset distance is too large, reducing it to half the smallest radius")
        offset_distance = smallest_radius / 2
    
    for i in range(steps):
        # calculate current step's radius
        curr_radius = radius*(i+1)/steps
        
        # calculate current step's depth
        curr_depth = step_depth*i
        
        # create a plane at the current depth
        curr_plane = rg.Plane(center_point + rg.Vector3d.ZAxis*(-curr_depth), rg.Vector3d.ZAxis)
        
        # create a circle at the current plane with the current radius
        curr_circle = rg.Circle(curr_plane, curr_radius)
        
        # create offset curve
        offset_curves = curr_circle.ToNurbsCurve().Offset(rg.Plane.WorldXY, -offset_distance, rs.UnitAbsoluteTolerance(), rg.CurveOffsetCornerStyle.Sharp)
        
        # check if the offset operation was successful
        if offset_curves is None:
            print("Failed to offset curve at step {}".format(i))
        else:
            # add the circle and offset curve to the terraces list as separate elements
            terraces.append(curr_circle.ToNurbsCurve())
            terraces.append(offset_curves[0])
            
            # create planar surface between terrace and its offset curve
            loft_result = rg.Brep.CreateFromLoft([curr_circle.ToNurbsCurve(), offset_curves[0]], rg.Point3d.Unset, rg.Point3d.Unset, rg.LoftType.Normal, False)
            if loft_result is not None and len(loft_result) > 0:
                flat_surfaces.extend(loft_result)
            
            # if it's not the first step, loft the current and previous curves to create a surface
            if i > 0:
                prev_terrace = terraces[-3]  # get the previous terrace curve
                curr_terrace = terraces[-2]  # get the current terrace curve
                loft_results = rg.Brep.CreateFromLoft([prev_terrace, curr_terrace], rg.Point3d.Unset, rg.Point3d.Unset, rg.LoftType.Normal, False)
                if loft_results is not None and len(loft_results) > 0:
                    surfaces.extend(loft_results)
    
    return terraces, surfaces, flat_surfaces

mine, surfaces, flats = generate_mine(radius, depth, steps, center_point_input, offset_distance)

# Outputs
a = mine
s = surfaces
f = flats
# ---------- end open_pit_mine ----------
panel = Panel(open_pit_mine.out)
geometry = Geometry(open_pit_mine.f)
geometry_2 = Geometry(open_pit_mine.a)
geometry_3 = Geometry(open_pit_mine.s)

construct_point_2 = ConstructPoint(XCoordinate=0, YCoordinate=0, ZCoordinate=0)
open_pit_mine_2 = GhPythonScript(
    x=Slider(65.923, range=0..100),
    y=Slider(-22.781, range=-100..100),
    z=Slider(3, range=0..10),
    a=construct_point_2,
    d=Slider(-9.077, range=-10..10),
    f=Slider(0.7402, range=0..1),
    p=Slider(124, range=0..124))  # -> out, a, s, f; inputs z: Int32, a: Point3d, p: Int32
# ---------- open_pit_mine_2: Python ----------
__author__ = "Sculpture"
__version__ = "2023.06.28"

import Rhino.Geometry as rg
import rhinoscriptsyntax as rs
import random
import math  # Add this line

# Inputs
radius = x  # Radius of the mine
depth = y  # Depth of the mine
steps = z  # Number of steps or terraces
center_point_input = a  # Position of the mine
offset_distance = d  # Offset distance for creating steps
noise_factor = f  # The amount of noise (random radial displacement)
point_count = p  # The number of points on the curve

# Generate mine
def generate_mine(radius, depth, steps, center_point_input, offset_distance, noise_factor, point_count):
    # list to hold all terraces
    terraces = []
    
    # list to hold lofted surfaces
    surfaces = []
    
    # list to hold flat surfaces
    flat_surfaces = []
    
    # calculate depth of each step
    step_depth = depth/steps
    
    # Convert the input into a valid 3D point
    center_point = rs.coerce3dpoint(center_point_input)
    if center_point is None:
        center_point = rg.Point3d(0, 0, 0)  # default to origin if input is invalid

    # calculate the smallest radius
    smallest_radius = radius/steps
    
    # ensure offset_distance is smaller than the smallest radius
    if offset_distance >= smallest_radius:
        print("Offset distance is too large, reducing it to half the smallest radius")
        offset_distance = smallest_radius / 2
    
    for i in range(steps):
        # calculate current step's radius
        curr_radius = radius*(i+1)/steps
        
        # calculate current step's depth
        curr_depth = step_depth*i
        
        # create a plane at the current depth
        curr_plane = rg.Plane(center_point + rg.Vector3d.ZAxis*(-curr_depth), rg.Vector3d.ZAxis)
        
        # create points on circle with noise
        angle_step = 2*3.1415926/(point_count-1)  # Subtract one to account for the closing point
        points = []
        for j in range(point_count):
            angle = j*angle_step
            noise = random.uniform(-noise_factor, noise_factor)
            point = rg.Point3d.Add(center_point, rg.Vector3d((curr_radius + noise)*math.cos(angle), (curr_radius + noise)*math.sin(angle), -curr_depth))
            points.append(point)
        points.append(points[0])  # Add the first point again to close the curve
        noisy_curve = rg.Curve.CreateInterpolatedCurve(points, 3)
        
        # create offset curve
        offset_curves = noisy_curve.Offset(rg.Plane.WorldXY, -offset_distance, rs.UnitAbsoluteTolerance(), rg.CurveOffsetCornerStyle.Sharp)
        
        # check if the offset operation was successful
        if offset_curves is None:
            print("Failed to offset curve at step {}".format(i))
        else:
            # add the curve and offset curve to the terraces list as separate elements
            terraces.append(noisy_curve)
            terraces.append(offset_curves[0])
            
            # create planar surface between terrace and its offset curve
            loft_result = rg.Brep.CreateFromLoft([noisy_curve, offset_curves[0]], rg.Point3d.Unset, rg.Point3d.Unset, rg.LoftType.Normal, False)
            if loft_result is not None and len(loft_result) > 0:
                flat_surfaces.extend(loft_result)
            
            # if it's not the first step, loft the current and previous curves to create a surface
            if i > 0:
                prev_terrace = terraces[-3]  # get the previous terrace curve
                curr_terrace = terraces[-2]  # get the current terrace curve
                loft_results = rg.Brep.CreateFromLoft([prev_terrace, curr_terrace], rg.Point3d.Unset, rg.Point3d.Unset, rg.LoftType.Normal, False)
                if loft_results is not None and len(loft_results) > 0:
                    surfaces.extend(loft_results)
    
    return terraces, surfaces, flat_surfaces

mine, surfaces, flats = generate_mine(radius, depth, steps, center_point_input, offset_distance, noise_factor, point_count)

# Outputs
a = mine
s = surfaces
f = flats
# ---------- end open_pit_mine_2 ----------
panel_2 = Panel(open_pit_mine_2.out)
geometry_4 = Geometry(open_pit_mine_2.f)
geometry_5 = Geometry(open_pit_mine_2.a)
geometry_6 = Geometry(open_pit_mine_2.s)

construct_point_3 = ConstructPoint(XCoordinate=0, YCoordinate=0, ZCoordinate=0)
open_pit_mine_3 = GhPythonScript(
    x=Slider(61.882, range=0..100),
    y=Slider(-12.85, range=-100..100),
    z=Slider(3, range=0..10),
    a=construct_point_3,
    d=Slider(-8.473, range=-10..10))  # -> out, a; inputs z: Int32, a: Point3d
# ---------- open_pit_mine_3: Python ----------
__author__ = "Sculpture"
__version__ = "2023.06.28"

import Rhino.Geometry as rg
import rhinoscriptsyntax as rs

# Inputs
radius = x  # Radius of the mine
depth = y  # Depth of the mine
steps = z  # Number of steps or terraces
center_point_input = a  # Position of the mine
offset_distance = d  # Offset distance for creating steps

# Generate mine
def generate_mine(radius, depth, steps, center_point_input, offset_distance):
    # list to hold all terraces
    terraces = []
    
    # calculate depth of each step
    step_depth = depth/steps
    
    # Convert the input into a valid 3D point
    center_point = rs.coerce3dpoint(center_point_input)
    if center_point is None:
        center_point = rg.Point3d(0, 0, 0)  # default to origin if input is invalid

    # calculate the smallest radius
    smallest_radius = radius/steps
    
    # ensure offset_distance is smaller than the smallest radius
    if offset_distance >= smallest_radius:
        print("Offset distance is too large, reducing it to half the smallest radius")
        offset_distance = smallest_radius / 2
    
    for i in range(steps):
        # calculate current step's radius
        curr_radius = radius*(i+1)/steps
        
        # calculate current step's depth
        curr_depth = step_depth*i
        
        # create a plane at the current depth
        curr_plane = rg.Plane(center_point + rg.Vector3d.ZAxis*(-curr_depth), rg.Vector3d.ZAxis)
        
        # create a circle at the current plane with the current radius
        curr_circle = rg.Circle(curr_plane, curr_radius)
        
        # create offset curve
        offset_curves = curr_circle.ToNurbsCurve().Offset(rg.Plane.WorldXY, -offset_distance, rs.UnitAbsoluteTolerance(), rg.CurveOffsetCornerStyle.Sharp)
        
        # check if the offset operation was successful
        if offset_curves is None:
            print("Failed to offset curve at step {}".format(i))
        else:
            # add the circle and offset curve to the terraces list as separate elements
            terraces.append(curr_circle.ToNurbsCurve())
            terraces.append(offset_curves[0])
    
    return terraces

mine = generate_mine(radius, depth, steps, center_point_input, offset_distance)

# Outputs
a = mine
# ---------- end open_pit_mine_3 ----------
panel_3 = Panel(open_pit_mine_3.out)
geometry_7 = Geometry(open_pit_mine_3.a)
loft = Loft(Curves=geometry_7, Options={Adjust=False, Closed=False, LoftEnds=0, LoftSimp=0, LoftType=0, Rebuild=10, Refit=0.01})

# ----
# GPT IS MY COLLEGE,
# summer school 2023
# Learn Grasshopper for Rhino3d from Wickerson Studios
# URBAN ENGINEERING
# Infrastucture and Technology in Modern Landscape
# 
# CONVENIENTLY DOWNLOAD ALL REPOITORIES
# On Sale
# $9.99
# https://lnkd.in/gxAyuQ7W
# www.wickersonstudios.com
# 
# #technology #engineering #school
# OPEN PIT MINE
number_slider = Slider(13.6, range=0..100)
construct_point_4 = ConstructPoint(XCoordinate=0, YCoordinate=0, ZCoordinate=0)
construct_point_5 = ConstructPoint(XCoordinate=0, YCoordinate=0, ZCoordinate=0)
construct_point_6 = ConstructPoint(XCoordinate=0, YCoordinate=0, ZCoordinate=0)
construct_point_7 = ConstructPoint(XCoordinate=0, YCoordinate=0, ZCoordinate=0)
open_pit_mine_4 = GhPythonScript(
    x=Slider(59.52, range=0..100),
    y=Slider(-33.228, range=-100..100),
    z=Slider(4, range=0..10),
    a=construct_point_4,
    d=Slider(-10, range=-10..10))  # -> out, a, s; inputs z: Int32, a: Point3d
# ---------- open_pit_mine_4: Python ----------
__author__ = "Sculpture"
__version__ = "2023.06.28"

import Rhino.Geometry as rg
import rhinoscriptsyntax as rs

# Inputs
radius = x  # Radius of the mine
depth = y  # Depth of the mine
steps = z  # Number of steps or terraces
center_point_input = a  # Position of the mine
offset_distance = d  # Offset distance for creating steps

# Generate mine
def generate_mine(radius, depth, steps, center_point_input, offset_distance):
    # list to hold all terraces
    terraces = []
    
    # list to hold lofted surfaces
    surfaces = []
    
    # calculate depth of each step
    step_depth = depth/steps
    
    # Convert the input into a valid 3D point
    center_point = rs.coerce3dpoint(center_point_input)
    if center_point is None:
        center_point = rg.Point3d(0, 0, 0)  # default to origin if input is invalid

    # calculate the smallest radius
    smallest_radius = radius/steps
    
    # ensure offset_distance is smaller than the smallest radius
    if offset_distance >= smallest_radius:
        print("Offset distance is too large, reducing it to half the smallest radius")
        offset_distance = smallest_radius / 2
    
    for i in range(steps):
        # calculate current step's radius
        curr_radius = radius*(i+1)/steps
        
        # calculate current step's depth
        curr_depth = step_depth*i
        
        # create a plane at the current depth
        curr_plane = rg.Plane(center_point + rg.Vector3d.ZAxis*(-curr_depth), rg.Vector3d.ZAxis)
        
        # create a circle at the current plane with the current radius
        curr_circle = rg.Circle(curr_plane, curr_radius)
        
        # create offset curve
        offset_curves = curr_circle.ToNurbsCurve().Offset(rg.Plane.WorldXY, -offset_distance, rs.UnitAbsoluteTolerance(), rg.CurveOffsetCornerStyle.Sharp)
        
        # check if the offset operation was successful
        if offset_curves is None:
            print("Failed to offset curve at step {}".format(i))
        else:
            # add the circle and offset curve to the terraces list as separate elements
            terraces.append(curr_circle.ToNurbsCurve())
            terraces.append(offset_curves[0])
            
            # if it's not the first step, loft the current and previous curves to create a surface
            if i > 0:
                prev_terrace = terraces[-3]  # get the previous terrace curve
                curr_terrace = terraces[-2]  # get the current terrace curve
                loft_results = rg.Brep.CreateFromLoft([prev_terrace, curr_terrace], rg.Point3d.Unset, rg.Point3d.Unset, rg.LoftType.Normal, False)
                if loft_results is not None and len(loft_results) > 0:
                    surfaces.extend(loft_results)
    
    return terraces, surfaces

mine, surfaces = generate_mine(radius, depth, steps, center_point_input, offset_distance)

# Outputs
a = mine
s = surfaces
# ---------- end open_pit_mine_4 ----------
open_pit_mine_5 = GhPythonScript(
    x=Slider(65.64, range=0..100),
    y=Slider(-23.708, range=-100..100),
    z=Slider(5, range=0..10),
    a=construct_point_5,
    d=Slider(-10, range=-10..10))  # -> out, a, s, f; inputs z: Int32, a: Point3d
# ---------- open_pit_mine_5: Python ----------
__author__ = "Sculpture"
__version__ = "2023.06.28"

import Rhino.Geometry as rg
import rhinoscriptsyntax as rs

# Inputs
radius = x  # Radius of the mine
depth = y  # Depth of the mine
steps = z  # Number of steps or terraces
center_point_input = a  # Position of the mine
offset_distance = d  # Offset distance for creating steps

# Generate mine
def generate_mine(radius, depth, steps, center_point_input, offset_distance):
    # list to hold all terraces
    terraces = []
    
    # list to hold lofted surfaces
    surfaces = []
    
    # list to hold flat surfaces
    flat_surfaces = []
    
    # calculate depth of each step
    step_depth = depth/steps
    
    # Convert the input into a valid 3D point
    center_point = rs.coerce3dpoint(center_point_input)
    if center_point is None:
        center_point = rg.Point3d(0, 0, 0)  # default to origin if input is invalid

    # calculate the smallest radius
    smallest_radius = radius/steps
    
    # ensure offset_distance is smaller than the smallest radius
    if offset_distance >= smallest_radius:
        print("Offset distance is too large, reducing it to half the smallest radius")
        offset_distance = smallest_radius / 2
    
    for i in range(steps):
        # calculate current step's radius
        curr_radius = radius*(i+1)/steps
        
        # calculate current step's depth
        curr_depth = step_depth*i
        
        # create a plane at the current depth
        curr_plane = rg.Plane(center_point + rg.Vector3d.ZAxis*(-curr_depth), rg.Vector3d.ZAxis)
        
        # create a circle at the current plane with the current radius
        curr_circle = rg.Circle(curr_plane, curr_radius)
        
        # create offset curve
        offset_curves = curr_circle.ToNurbsCurve().Offset(rg.Plane.WorldXY, -offset_distance, rs.UnitAbsoluteTolerance(), rg.CurveOffsetCornerStyle.Sharp)
        
        # check if the offset operation was successful
        if offset_curves is None:
            print("Failed to offset curve at step {}".format(i))
        else:
            # add the circle and offset curve to the terraces list as separate elements
            terraces.append(curr_circle.ToNurbsCurve())
            terraces.append(offset_curves[0])
            
            # create planar surface from offset curve
            offset_surface = rg.Brep.CreatePlanarBreps(offset_curves)
            if offset_surface:
                flat_surfaces.extend(offset_surface)
            
            # if it's not the first step, loft the current and previous curves to create a surface
            if i > 0:
                prev_terrace = terraces[-3]  # get the previous terrace curve
                curr_terrace = terraces[-2]  # get the current terrace curve
                loft_results = rg.Brep.CreateFromLoft([prev_terrace, curr_terrace], rg.Point3d.Unset, rg.Point3d.Unset, rg.LoftType.Normal, False)
                if loft_results is not None and len(loft_results) > 0:
                    surfaces.extend(loft_results)
    
    return terraces, surfaces, flat_surfaces

mine, surfaces, flats = generate_mine(radius, depth, steps, center_point_input, offset_distance)

# Outputs
a = mine
s = surfaces
f = flats
# ---------- end open_pit_mine_5 ----------
open_pit_mine_6 = GhPythonScript(
    x=Slider(26.336, range=0..100),
    y=Slider(-19.084, range=-100..100),
    z=Slider(4, range=0..10),
    a=construct_point_6,
    d=Slider(-3.758, range=-10..10),
    f=Slider(0.178, range=0..1),
    p=Slider(5, range=0..5))  # -> out, a, s, f; inputs z: Int32, a: Point3d, p: Int32
# ---------- open_pit_mine_6: Python ----------
__author__ = "Sculpture"
__version__ = "2023.06.28"

import Rhino.Geometry as rg
import rhinoscriptsyntax as rs
import random

# Inputs
radius = x  # Radius of the mine
depth = y  # Depth of the mine
steps = z  # Number of steps or terraces
center_point_input = a  # Position of the mine
offset_distance = d  # Offset distance for creating steps
noise_factor = f  # The amount of noise (random radial displacement)

# Generate mine
def generate_mine(radius, depth, steps, center_point_input, offset_distance, noise_factor):
    # list to hold all terraces
    terraces = []
    
    # list to hold lofted surfaces
    surfaces = []
    
    # list to hold flat surfaces
    flat_surfaces = []
    
    # calculate depth of each step
    step_depth = depth/steps
    
    # Convert the input into a valid 3D point
    center_point = rs.coerce3dpoint(center_point_input)
    if center_point is None:
        center_point = rg.Point3d(0, 0, 0)  # default to origin if input is invalid

    # calculate the smallest radius
    smallest_radius = radius/steps
    
    # ensure offset_distance is smaller than the smallest radius
    if offset_distance >= smallest_radius:
        print("Offset distance is too large, reducing it to half the smallest radius")
        offset_distance = smallest_radius / 2
    
    # number of points on the curve
    point_count = p
    
    for i in range(steps):
        # calculate current step's radius
        curr_radius = radius*(i+1)/steps
        
        # calculate current step's depth
        curr_depth = step_depth*i
        
        # create a plane at the current depth
        curr_plane = rg.Plane(center_point + rg.Vector3d.ZAxis*(-curr_depth), rg.Vector3d.ZAxis)
        
        # create a circle at the current plane with the current radius
        curr_circle = rg.Circle(curr_plane, curr_radius)
        
        # create points on circle with noise
        angle_step = 2*3.1415926/point_count
        points = []
        for j in range(point_count):
            angle = j*angle_step
            noise = random.uniform(-noise_factor, noise_factor)
            point = rg.Point3d.Add(curr_circle.Center, rg.Vector3d(curr_circle.Radius + noise, angle, 0))
            points.append(point)
        noisy_curve = rg.Curve.CreateInterpolatedCurve(points, 3)
        
        # create offset curve
        offset_curves = noisy_curve.Offset(rg.Plane.WorldXY, -offset_distance, rs.UnitAbsoluteTolerance(), rg.CurveOffsetCornerStyle.Sharp)
        
        # check if the offset operation was successful
        if offset_curves is None:
            print("Failed to offset curve at step {}".format(i))
        else:
            # add the circle and offset curve to the terraces list as separate elements
            terraces.append(noisy_curve)
            terraces.append(offset_curves[0])
            
            # create planar surface between terrace and its offset curve
            loft_result = rg.Brep.CreateFromLoft([noisy_curve, offset_curves[0]], rg.Point3d.Unset, rg.Point3d.Unset, rg.LoftType.Normal, False)
            if loft_result is not None and len(loft_result) > 0:
                flat_surfaces.extend(loft_result)
            
            # if it's not the first step, loft the current and previous curves to create a surface
            if i > 0:
                prev_terrace = terraces[-3]  # get the previous terrace curve
                curr_terrace = terraces[-2]  # get the current terrace curve
                loft_results = rg.Brep.CreateFromLoft([prev_terrace, curr_terrace], rg.Point3d.Unset, rg.Point3d.Unset, rg.LoftType.Normal, False)
                if loft_results is not None and len(loft_results) > 0:
                    surfaces.extend(loft_results)
    
    return terraces, surfaces, flat_surfaces

mine, surfaces, flats = generate_mine(radius, depth, steps, center_point_input, offset_distance, noise_factor)

# Outputs
a = mine
s = surfaces
f = flats
# ---------- end open_pit_mine_6 ----------
open_pit_mine_7 = GhPythonScript(x=number_slider, y=Slider(-10.64, range=-100..100), z=Slider(3, range=0..10), a=construct_point_7)  # -> out, a; inputs z: Int32, a: Point3d
# ---------- open_pit_mine_7: Python ----------
__author__ = "Sculpture"
__version__ = "2023.06.28"

import Rhino.Geometry as rg
import rhinoscriptsyntax as rs

# Inputs
radius = x  # Radius of the mine
depth = y  # Depth of the mine
steps = z  # Number of steps or terraces
center_point = rs.coerce3dpoint(a)  # Position of the mine

# Generate mine
def generate_mine(radius, depth, steps, center_point):
    # list to hold all terraces
    terraces = []
    
    # calculate depth of each step
    step_depth = depth/steps
    
    for i in range(steps):
        # calculate current step's radius
        curr_radius = radius*(i+1)/steps
        
        # calculate current step's depth
        curr_depth = step_depth*i
        
        # create a plane at the current depth
        curr_plane = rg.Plane(center_point + rg.Vector3d.ZAxis*(-curr_depth), rg.Vector3d.ZAxis)
        
        # create a circle at the current plane with the current radius
        curr_circle = rg.Circle(curr_plane, curr_radius)
        
        # add the circle to the terraces list
        terraces.append(curr_circle.ToNurbsCurve())
    
    return terraces

mine = generate_mine(radius, depth, steps, center_point)

# Outputs
a = mine
# ---------- end open_pit_mine_7 ----------
panel_4 = Panel(open_pit_mine_4.out)
panel_5 = Panel(open_pit_mine_5.out)
geometry_8 = Geometry(open_pit_mine_4.a)
geometry_9 = Geometry(open_pit_mine_4.s)
geometry_10 = Geometry(open_pit_mine_5.f)
geometry_11 = Geometry(open_pit_mine_5.a)
geometry_12 = Geometry(open_pit_mine_5.s)
panel_6 = Panel(open_pit_mine_6.out)
geometry_13 = Geometry(open_pit_mine_6.f)
geometry_14 = Geometry(open_pit_mine_6.a)
geometry_15 = Geometry(open_pit_mine_6.s)
panel_7 = Panel(open_pit_mine_7.out)
geometry_16 = Geometry(open_pit_mine_7.a)
construct_point_8 = ConstructPoint(XCoordinate=0, YCoordinate=0, ZCoordinate=0)
open_pit_mine_8 = GhPythonScript(
    x=Slider(56.305, range=0..100),
    y=Slider(-21.743, range=-100..100),
    z=Slider(4, range=0..10),
    a=construct_point_8,
    d=Slider(-9.607, range=-10..10))  # -> out, a, s, f, r; inputs z: Int32, a: Point3d
# ---------- open_pit_mine_8: Python ----------
__author__ = "Sculpture"
__version__ = "2023.06.28"

import Rhino.Geometry as rg
import rhinoscriptsyntax as rs

# Inputs
radius = x  # Radius of the mine
depth = y  # Depth of the mine
steps = z  # Number of steps or terraces
center_point_input = a  # Position of the mine
offset_distance = d  # Offset distance for creating steps

# Generate mine
def generate_mine(radius, depth, steps, center_point_input, offset_distance):
    # list to hold all terraces
    terraces = []
    
    # list to hold lofted surfaces
    surfaces = []
    
    # list to hold flat surfaces
    flat_surfaces = []
    
    # list to hold the roads
    roads = []
    
    # calculate depth of each step
    step_depth = depth/steps
    
    # Convert the input into a valid 3D point
    center_point = rs.coerce3dpoint(center_point_input)
    if center_point is None:
        center_point = rg.Point3d(0, 0, 0)  # default to origin if input is invalid

    # calculate the smallest radius
    smallest_radius = radius/steps
    
    # ensure offset_distance is smaller than the smallest radius
    if offset_distance >= smallest_radius:
        print("Offset distance is too large, reducing it to half the smallest radius")
        offset_distance = smallest_radius / 2
    
    for i in range(steps):
        # calculate current step's radius
        curr_radius = radius*(i+1)/steps
        
        # calculate current step's depth
        curr_depth = step_depth*i
        
        # create a plane at the current depth
        curr_plane = rg.Plane(center_point + rg.Vector3d.ZAxis*(-curr_depth), rg.Vector3d.ZAxis)
        
        # create a circle at the current plane with the current radius
        curr_circle = rg.Circle(curr_plane, curr_radius)
        
        # create offset curve
        offset_curves = curr_circle.ToNurbsCurve().Offset(rg.Plane.WorldXY, -offset_distance, rs.UnitAbsoluteTolerance(), rg.CurveOffsetCornerStyle.Sharp)
        
        # check if the offset operation was successful
        if offset_curves is None:
            print("Failed to offset curve at step {}".format(i))
        else:
            # add the circle and offset curve to the terraces list as separate elements
            terraces.append(curr_circle.ToNurbsCurve())
            terraces.append(offset_curves[0])
            
            # create planar surface between terrace and its offset curve
            loft_result = rg.Brep.CreateFromLoft([curr_circle.ToNurbsCurve(), offset_curves[0]], rg.Point3d.Unset, rg.Point3d.Unset, rg.LoftType.Normal, False)
            if loft_result is not None and len(loft_result) > 0:
                flat_surfaces.extend(loft_result)
            
            # if it's not the first step, loft the current and previous curves to create a surface
            if i > 0:
                prev_terrace = terraces[-3]  # get the previous terrace curve
                curr_terrace = terraces[-2]  # get the current terrace curve
                loft_results = rg.Brep.CreateFromLoft([prev_terrace, curr_terrace], rg.Point3d.Unset, rg.Point3d.Unset, rg.LoftType.Normal, False)
                if loft_results is not None and len(loft_results) > 0:
                    surfaces.extend(loft_results)
                    
                # create a road between this terrace and the previous one
                road_start = prev_terrace.PointAtStart  # Get the start point of the previous terrace
                road_end = curr_terrace.PointAtEnd  # Get the end point of the current terrace
                road = rg.Line(road_start, road_end)
                roads.append(road)
    
    return terraces, surfaces, flat_surfaces, roads

mine, surfaces, flats, roads = generate_mine(radius, depth, steps, center_point_input, offset_distance)

# Outputs
a = mine
s = surfaces
f = flats
r = roads
# ---------- end open_pit_mine_8 ----------
panel_8 = Panel(open_pit_mine_8.out)
geometry_17 = Geometry(open_pit_mine_8.f)
geometry_18 = Geometry(open_pit_mine_8.r)
geometry_19 = Geometry(open_pit_mine_8.a)
geometry_20 = Geometry(open_pit_mine_8.s)
construct_point_9 = ConstructPoint(XCoordinate=0, YCoordinate=0, ZCoordinate=0)
open_pit_mine_9 = GhPythonScript(
    x=Slider(56.305, range=0..100),
    y=Slider(-21.743, range=-100..100),
    z=Slider(4, range=0..10),
    a=construct_point_9,
    d=Slider(-9.607, range=-10..10))  # -> out, a, s, f, r; inputs z: Int32, a: Point3d
# ---------- open_pit_mine_9: Python ----------
__author__ = "Sculpture"
__version__ = "2023.06.28"

import Rhino.Geometry as rg
import rhinoscriptsyntax as rs
import random

# Inputs
radius = x  # Radius of the mine
depth = y  # Depth of the mine
steps = z  # Number of steps or terraces
center_point_input = a  # Position of the mine
offset_distance = d  # Offset distance for creating steps

# Generate mine
def generate_mine(radius, depth, steps, center_point_input, offset_distance):
    # list to hold all terraces
    terraces = []
    
    # list to hold lofted surfaces
    surfaces = []
    
    # list to hold flat surfaces
    flat_surfaces = []
    
    # list to hold the roads
    roads = []
    
    # calculate depth of each step
    step_depth = depth/steps
    
    # Convert the input into a valid 3D point
    center_point = rs.coerce3dpoint(center_point_input)
    if center_point is None:
        center_point = rg.Point3d(0, 0, 0)  # default to origin if input is invalid

    # calculate the smallest radius
    smallest_radius = radius/steps
    
    # ensure offset_distance is smaller than the smallest radius
    if offset_distance >= smallest_radius:
        print("Offset distance is too large, reducing it to half the smallest radius")
        offset_distance = smallest_radius / 2
    
    for i in range(steps):
        # calculate current step's radius
        curr_radius = radius*(i+1)/steps
        
        # calculate current step's depth
        curr_depth = step_depth*i
        
        # create a plane at the current depth
        curr_plane = rg.Plane(center_point + rg.Vector3d.ZAxis*(-curr_depth), rg.Vector3d.ZAxis)
        
        # create a circle at the current plane with the current radius
        curr_circle = rg.Circle(curr_plane, curr_radius)
        
        # create offset curve
        offset_curves = curr_circle.ToNurbsCurve().Offset(rg.Plane.WorldXY, -offset_distance, rs.UnitAbsoluteTolerance(), rg.CurveOffsetCornerStyle.Sharp)
        
        # check if the offset operation was successful
        if offset_curves is None:
            print("Failed to offset curve at step {}".format(i))
        else:
            # add the circle and offset curve to the terraces list as separate elements
            terraces.append(curr_circle.ToNurbsCurve())
            terraces.append(offset_curves[0])
            
            # create planar surface between terrace and its offset curve
            loft_result = rg.Brep.CreateFromLoft([curr_circle.ToNurbsCurve(), offset_curves[0]], rg.Point3d.Unset, rg.Point3d.Unset, rg.LoftType.Normal, False)
            if loft_result is not None and len(loft_result) > 0:
                flat_surfaces.extend(loft_result)
            
            # if it's not the first step, loft the current and previous curves to create a surface
            if i > 0:
                prev_terrace = terraces[-3]  # get the previous terrace curve
                curr_terrace = terraces[-2]  # get the current terrace curve
                loft_results = rg.Brep.CreateFromLoft([prev_terrace, curr_terrace], rg.Point3d.Unset, rg.Point3d.Unset, rg.LoftType.Normal, False)
                if loft_results is not None and len(loft_results) > 0:
                    surfaces.extend(loft_results)
                    
                # create a road between this terrace and the previous one
                t0 = random.uniform(0, 1)
                t1 = random.uniform(0, 1)
                road_start = prev_terrace.PointAt(t0)  # Get a random point on the previous terrace
                road_end = curr_terrace.PointAt(t1)  # Get a random point on the current terrace
                
                # generate points between the start and end of the road
                road_points = [road_start]
                for j in range(1, 10):  # 10 points are used here, but this can be adjusted
                    interp_point = rg.Point3d((1 - j / 10) * road_start.X + j / 10 * road_end.X,
                                              (1 - j / 10) * road_start.Y + j / 10 * road_end.Y,
                                              (1 - j / 10) * road_start.Z + j / 10 * road_end.Z)
                    road_points.append(interp_point)
                road_points.append(road_end)
                
                # create the road curve
                road = rg.Curve.CreateInterpolatedCurve(road_points, 3)
                roads.append(road)
    
    return terraces, surfaces, flat_surfaces, roads

mine, surfaces, flats, roads = generate_mine(radius, depth, steps, center_point_input, offset_distance)

# Outputs
a = mine
s = surfaces
f = flats
r = roads
# ---------- end open_pit_mine_9 ----------
panel_9 = Panel(open_pit_mine_9.out)
geometry_21 = Geometry(open_pit_mine_9.r)
geometry_22 = Geometry(open_pit_mine_9.f)
geometry_23 = Geometry(open_pit_mine_9.a)
geometry_24 = Geometry(open_pit_mine_9.s)
construct_point_10 = ConstructPoint(XCoordinate=0, YCoordinate=0, ZCoordinate=0)
open_pit_mine_10 = GhPythonScript(
    x=Slider(56.305, range=0..100),
    y=Slider(-21.743, range=-100..100),
    z=Slider(4, range=0..10),
    a=construct_point_10,
    d=Slider(-9.607, range=-10..10),
    rw=Slider(-5.369, range=-10..10))  # -> out, a, s, f, r, rs; inputs z: Int32, a: Point3d
# ---------- open_pit_mine_10: Python ----------
__author__ = "Sculpture"
__version__ = "2023.06.28"

import Rhino.Geometry as rg
import rhinoscriptsyntax as rs
import random

# Inputs
radius = x  # Radius of the mine
depth = y  # Depth of the mine
steps = z  # Number of steps or terraces
center_point_input = a  # Position of the mine
offset_distance = d  # Offset distance for creating steps
road_width = rw  # Width of the roads

# Generate mine
def generate_mine(radius, depth, steps, center_point_input, offset_distance, road_width):
    # list to hold all terraces
    terraces = []
    
    # list to hold lofted surfaces
    surfaces = []
    
    # list to hold flat surfaces
    flat_surfaces = []
    
    # list to hold the roads
    roads = []
    
    # list to hold the road surfaces
    road_surfaces = []
    
    # calculate depth of each step
    step_depth = depth/steps
    
    # Convert the input into a valid 3D point
    center_point = rs.coerce3dpoint(center_point_input)
    if center_point is None:
        center_point = rg.Point3d(0, 0, 0)  # default to origin if input is invalid

    # calculate the smallest radius
    smallest_radius = radius/steps
    
    # ensure offset_distance is smaller than the smallest radius
    if offset_distance >= smallest_radius:
        print("Offset distance is too large, reducing it to half the smallest radius")
        offset_distance = smallest_radius / 2
    
    for i in range(steps):
        # calculate current step's radius
        curr_radius = radius*(i+1)/steps
        
        # calculate current step's depth
        curr_depth = step_depth*i
        
        # create a plane at the current depth
        curr_plane = rg.Plane(center_point + rg.Vector3d.ZAxis*(-curr_depth), rg.Vector3d.ZAxis)
        
        # create a circle at the current plane with the current radius
        curr_circle = rg.Circle(curr_plane, curr_radius)
        
        # create offset curve
        offset_curves = curr_circle.ToNurbsCurve().Offset(rg.Plane.WorldXY, -offset_distance, rs.UnitAbsoluteTolerance(), rg.CurveOffsetCornerStyle.Sharp)
        
        # check if the offset operation was successful
        if offset_curves is None:
            print("Failed to offset curve at step {}".format(i))
        else:
            # add the circle and offset curve to the terraces list as separate elements
            terraces.append(curr_circle.ToNurbsCurve())
            terraces.append(offset_curves[0])
            
            # create planar surface between terrace and its offset curve
            loft_result = rg.Brep.CreateFromLoft([curr_circle.ToNurbsCurve(), offset_curves[0]], rg.Point3d.Unset, rg.Point3d.Unset, rg.LoftType.Normal, False)
            if loft_result is not None and len(loft_result) > 0:
                flat_surfaces.extend(loft_result)
            
            # if it's not the first step, loft the current and previous curves to create a surface
            if i > 0:
                prev_terrace = terraces[-3]  # get the previous terrace curve
                curr_terrace = terraces[-2]  # get the current terrace curve
                loft_results = rg.Brep.CreateFromLoft([prev_terrace, curr_terrace], rg.Point3d.Unset, rg.Point3d.Unset, rg.LoftType.Normal, False)
                if loft_results is not None and len(loft_results) > 0:
                    surfaces.extend(loft_results)
                    
                # create a road between this terrace and the previous one
                t0 = random.uniform(0, 1)
                t1 = random.uniform(0, 1)
                road_start = prev_terrace.PointAt(t0)  # Get a random point on the previous terrace
                road_end = curr_terrace.PointAt(t1)  # Get a random point on the current terrace
                
                # generate points between the start and end of the road
                road_points = [road_start]
                for j in range(1, 10):  # 10 points are used here, but this can be adjusted
                    interp_point = rg.Point3d((1 - j / 10) * road_start.X + j / 10 * road_end.X,
                                              (1 - j / 10) * road_start.Y + j / 10 * road_end.Y,
                                              (1 - j / 10) * road_start.Z + j / 10 * road_end.Z)
                    road_points.append(interp_point)
                road_points.append(road_end)
                
                # create the road curve
                road = rg.Curve.CreateInterpolatedCurve(road_points, 3)
                roads.append(road)
                
                # offset road curve towards the center of the mine
                offset_plane = rg.Plane(road_start, road_start - center_point, rg.Vector3d.ZAxis)  # create a plane for offsetting
                offset_roads = road.Offset(offset_plane, road_width, rs.UnitAbsoluteTolerance(), rg.CurveOffsetCornerStyle.Sharp)
                
                # check if offset operation was successful and create road surface by lofting
                if offset_roads is not None:
                    for offset_road in offset_roads:
                        road_surface = rg.Brep.CreateFromLoft([road, offset_road], rg.Point3d.Unset, rg.Point3d.Unset, rg.LoftType.Normal, False)
                        if road_surface is not None and len(road_surface) > 0:
                            road_surfaces.extend(road_surface)
    
    return terraces, surfaces, flat_surfaces, roads, road_surfaces

mine, surfaces, flats, roads, road_surfaces = generate_mine(radius, depth, steps, center_point_input, offset_distance, road_width)

# Outputs
a = mine
s = surfaces
f = flats
r = roads
rs = road_surfaces
# ---------- end open_pit_mine_10 ----------
geometry_25 = Geometry(open_pit_mine_10.f)
geometry_26 = Geometry(open_pit_mine_10.r)
geometry_27 = Geometry(open_pit_mine_10.a)
geometry_28 = Geometry(open_pit_mine_10.s)
geometry_29 = Geometry(open_pit_mine_10.rs)
panel_10 = Panel(open_pit_mine_10.out)
construct_point_11 = ConstructPoint(XCoordinate=0, YCoordinate=0, ZCoordinate=0)
open_pit_mine_11 = GhPythonScript(
    x=Slider(56.305, range=0..100),
    y=Slider(-21.743, range=-100..100),
    z=Slider(4, range=0..10),
    a=construct_point_11,
    d=Slider(-9.607, range=-10..10),
    rw=Slider(-6.328, range=-10..10))  # -> out, a, s, f, r, rs; inputs z: Int32, a: Point3d
# ---------- open_pit_mine_11: Python ----------
__author__ = "Sculpture"
__version__ = "2023.06.28"

import Rhino.Geometry as rg
import rhinoscriptsyntax as rs
import random

# Inputs
radius = x  # Radius of the mine
depth = y  # Depth of the mine
steps = z  # Number of steps or terraces
center_point_input = a  # Position of the mine
offset_distance = d  # Offset distance for creating steps
road_width = rw  # Width of the roads

# Generate mine
def generate_mine(radius, depth, steps, center_point_input, offset_distance, road_width):
    # list to hold all terraces
    terraces = []
    
    # list to hold lofted surfaces
    surfaces = []
    
    # list to hold flat surfaces
    flat_surfaces = []
    
    # list to hold the roads
    roads = []
    
    # list to hold the road surfaces
    road_surfaces = []
    
    # calculate depth of each step
    step_depth = depth/steps
    
    # Convert the input into a valid 3D point
    center_point = rs.coerce3dpoint(center_point_input)
    if center_point is None:
        center_point = rg.Point3d(0, 0, 0)  # default to origin if input is invalid

    # calculate the smallest radius
    smallest_radius = radius/steps
    
    # ensure offset_distance is smaller than the smallest radius
    if offset_distance >= smallest_radius:
        print("Offset distance is too large, reducing it to half the smallest radius")
        offset_distance = smallest_radius / 2
    
    for i in range(steps):
        # calculate current step's radius
        curr_radius = radius*(i+1)/steps
        
        # calculate current step's depth
        curr_depth = step_depth*i
        
        # create a plane at the current depth
        curr_plane = rg.Plane(center_point + rg.Vector3d.ZAxis*(-curr_depth), rg.Vector3d.ZAxis)
        
        # create a circle at the current plane with the current radius
        curr_circle = rg.Circle(curr_plane, curr_radius)
        
        # create offset curve
        offset_curves = curr_circle.ToNurbsCurve().Offset(rg.Plane.WorldXY, -offset_distance, rs.UnitAbsoluteTolerance(), rg.CurveOffsetCornerStyle.Sharp)
        
        # check if the offset operation was successful
        if offset_curves is None:
            print("Failed to offset curve at step {}".format(i))
        else:
            # add the circle and offset curve to the terraces list as separate elements
            terraces.append(curr_circle.ToNurbsCurve())
            terraces.append(offset_curves[0])
            
            # create planar surface between terrace and its offset curve
            loft_result = rg.Brep.CreateFromLoft([curr_circle.ToNurbsCurve(), offset_curves[0]], rg.Point3d.Unset, rg.Point3d.Unset, rg.LoftType.Normal, False)
            if loft_result is not None and len(loft_result) > 0:
                flat_surfaces.extend(loft_result)
            
            # if it's not the first step, loft the current and previous curves to create a surface
            if i > 0:
                prev_terrace = terraces[-3]  # get the previous terrace curve
                curr_terrace = terraces[-2]  # get the current terrace curve
                loft_results = rg.Brep.CreateFromLoft([prev_terrace, curr_terrace], rg.Point3d.Unset, rg.Point3d.Unset, rg.LoftType.Normal, False)
                if loft_results is not None and len(loft_results) > 0:
                    surfaces.extend(loft_results)
                    
                # create a road between this terrace and the previous one
                t0 = random.uniform(0, 1)
                t1 = random.uniform(0, 1)
                road_start = prev_terrace.PointAt(t0)  # Get a random point on the previous terrace
                road_end = curr_terrace.PointAt(t1)  # Get a random point on the current terrace
                
                # generate points between the start and end of the road
                road_points = [road_start]
                for j in range(1, 10):  # 10 points are used here, but this can be adjusted
                    interp_point = rg.Point3d((1 - j / 10) * road_start.X + j / 10 * road_end.X,
                                              (1 - j / 10) * road_start.Y + j / 10 * road_end.Y,
                                              (1 - j / 10) * road_start.Z + j / 10 * road_end.Z)
                    road_points.append(interp_point)
                road_points.append(road_end)
                
                # create the road curve
                road = rg.Curve.CreateInterpolatedCurve(road_points, 3)
                roads.append(road)
                
                # offset road curve towards the center of the mine
                offset_plane = rg.Plane(road_start, rg.Vector3d.XAxis, rg.Vector3d.YAxis)  # create a plane for offsetting parallel to xy plane
                offset_roads = road.Offset(offset_plane, road_width, rs.UnitAbsoluteTolerance(), rg.CurveOffsetCornerStyle.Sharp)
                
                # check if offset operation was successful and create road surface by lofting
                if offset_roads is not None:
                    for offset_road in offset_roads:
                        road_surface = rg.Brep.CreateFromLoft([road, offset_road], rg.Point3d.Unset, rg.Point3d.Unset, rg.LoftType.Normal, False)
                        if road_surface is not None and len(road_surface) > 0:
                            road_surfaces.extend(road_surface)
    
    return terraces, surfaces, flat_surfaces, roads, road_surfaces

mine, surfaces, flats, roads, road_surfaces = generate_mine(radius, depth, steps, center_point_input, offset_distance, road_width)

# Outputs
a = mine
s = surfaces
f = flats
r = roads
rs = road_surfaces
# ---------- end open_pit_mine_11 ----------
geometry_30 = Geometry(open_pit_mine_11.r)
geometry_31 = Geometry(open_pit_mine_11.f)
geometry_32 = Geometry(open_pit_mine_11.a)
geometry_33 = Geometry(open_pit_mine_11.s)
geometry_34 = Geometry(open_pit_mine_11.rs)
panel_11 = Panel(open_pit_mine_11.out)
construct_point_12 = ConstructPoint(XCoordinate=0, YCoordinate=0, ZCoordinate=0)
open_pit_mine_12 = GhPythonScript(
    x=Slider(56.305, range=0..100),
    y=Slider(-33.436, range=-100..100),
    z=Slider(4, range=0..10),
    a=construct_point_12,
    d=Slider(-7.352, range=-10..10),
    rw=Slider(4.246, range=-10..10),
    ms=Slider(6.17, range=0..10))  # -> out, a, s, f, r, rs; inputs z: Int32, a: Point3d
# ---------- open_pit_mine_12: Python ----------
__author__ = "Sculpture"
__version__ = "2023.06.28"

import Rhino.Geometry as rg
import rhinoscriptsyntax as rs
import random

# Inputs
radius = x  # Radius of the mine
depth = y  # Depth of the mine
steps = z  # Number of steps or terraces
center_point_input = a  # Position of the mine
offset_distance = d  # Offset distance for creating steps
road_width = rw  # Width of the roads
max_slope = ms  # Maximum slope for the roads

# Generate mine
def generate_mine(radius, depth, steps, center_point_input, offset_distance, road_width, max_slope):
    # list to hold all terraces
    terraces = []
    
    # list to hold lofted surfaces
    surfaces = []
    
    # list to hold flat surfaces
    flat_surfaces = []
    
    # list to hold the roads
    roads = []
    
    # list to hold the road surfaces
    road_surfaces = []
    
    # calculate depth of each step
    step_depth = depth/steps
    
    # Convert the input into a valid 3D point
    center_point = rs.coerce3dpoint(center_point_input)
    if center_point is None:
        center_point = rg.Point3d(0, 0, 0)  # default to origin if input is invalid

    # calculate the smallest radius
    smallest_radius = radius/steps
    
    # ensure offset_distance is smaller than the smallest radius
    if offset_distance >= smallest_radius:
        print("Offset distance is too large, reducing it to half the smallest radius")
        offset_distance = smallest_radius / 2
    
    for i in range(steps):
        # calculate current step's radius
        curr_radius = radius*(i+1)/steps
        
        # calculate current step's depth
        curr_depth = step_depth*i
        
        # create a plane at the current depth
        curr_plane = rg.Plane(center_point + rg.Vector3d.ZAxis*(-curr_depth), rg.Vector3d.ZAxis)
        
        # create a circle at the current plane with the current radius
        curr_circle = rg.Circle(curr_plane, curr_radius)
        
        # create offset curve
        offset_curves = curr_circle.ToNurbsCurve().Offset(rg.Plane.WorldXY, -offset_distance, rs.UnitAbsoluteTolerance(), rg.CurveOffsetCornerStyle.Sharp)
        
        # check if the offset operation was successful
        if offset_curves is None:
            print("Failed to offset curve at step {}".format(i))
        else:
            # add the circle and offset curve to the terraces list as separate elements
            terraces.append(curr_circle.ToNurbsCurve())
            terraces.append(offset_curves[0])
            
            # create planar surface between terrace and its offset curve
            loft_result = rg.Brep.CreateFromLoft([curr_circle.ToNurbsCurve(), offset_curves[0]], rg.Point3d.Unset, rg.Point3d.Unset, rg.LoftType.Normal, False)
            if loft_result is not None and len(loft_result) > 0:
                flat_surfaces.extend(loft_result)
            
            # if it's not the first step, loft the current and previous curves to create a surface
            if i > 0:
                prev_terrace = terraces[-3]  # get the previous terrace curve
                curr_terrace = terraces[-2]  # get the current terrace curve
                loft_results = rg.Brep.CreateFromLoft([prev_terrace, curr_terrace], rg.Point3d.Unset, rg.Point3d.Unset, rg.LoftType.Normal, False)
                if loft_results is not None and len(loft_results) > 0:
                    surfaces.extend(loft_results)
                    
                # create a road between this terrace and the previous one
                t0 = random.uniform(0, 1)
                t1 = random.uniform(0, 1)
                road_start = prev_terrace.PointAt(t0)  # Get a random point on the previous terrace
                road_end = curr_terrace.PointAt(t1)  # Get a random point on the current terrace
                
                # Make sure the slope of the road isn't too steep
                if abs(road_start.Z - road_end.Z) > max_slope:
                    # If the slope is too steep, adjust the end point of the road
                    road_end.Z = road_start.Z + max_slope * (1 if road_start.Z < road_end.Z else -1)
                
                # generate points between the start and end of the road
                road_points = [road_start]
                for j in range(1, 10):  # 10 points are used here, but this can be adjusted
                    interp_point = rg.Point3d((1 - j / 10) * road_start.X + j / 10 * road_end.X,
                                              (1 - j / 10) * road_start.Y + j / 10 * road_end.Y,
                                              (1 - j / 10) * road_start.Z + j / 10 * road_end.Z)
                    road_points.append(interp_point)
                road_points.append(road_end)
                
                # create the road curve
                road = rg.Curve.CreateInterpolatedCurve(road_points, 3)
                roads.append(road)
                
                # offset road curve towards the center of the mine
                offset_plane = rg.Plane(road_start, rg.Vector3d.XAxis, rg.Vector3d.YAxis)  # create a plane for offsetting parallel to xy plane
                offset_roads = road.Offset(offset_plane, road_width, rs.UnitAbsoluteTolerance(), rg.CurveOffsetCornerStyle.Sharp)
                
                # check if offset operation was successful and create road surface by lofting
                if offset_roads is not None:
                    for offset_road in offset_roads:
                        road_surface = rg.Brep.CreateFromLoft([road, offset_road], rg.Point3d.Unset, rg.Point3d.Unset, rg.LoftType.Normal, False)
                        if road_surface is not None and len(road_surface) > 0:
                            road_surfaces.extend(road_surface)
    
    return terraces, surfaces, flat_surfaces, roads, road_surfaces

mine, surfaces, flats, roads, road_surfaces = generate_mine(radius, depth, steps, center_point_input, offset_distance, road_width, max_slope)

# Outputs
a = mine
s = surfaces
f = flats
r = roads
rs = road_surfaces
# ---------- end open_pit_mine_12 ----------
geometry_35 = Geometry(open_pit_mine_12.f)
geometry_36 = Geometry(open_pit_mine_12.a)
geometry_37 = Geometry(open_pit_mine_12.s)
geometry_38 = Geometry(open_pit_mine_12.rs)
geometry_39 = Geometry(open_pit_mine_12.r)
panel_12 = Panel(open_pit_mine_12.out)
construct_point_13 = ConstructPoint(XCoordinate=0, YCoordinate=0, ZCoordinate=0)
open_pit_mine_13 = GhPythonScript(
    x=Slider(85.55, range=0..100),
    y=Slider(-15.611, range=-100..100),
    z=Slider(6, range=0..10),
    a=construct_point_13,
    d=Slider(-4.462, range=-10..10),
    rw=Slider(3.294, range=-10..10),
    ms=Slider(0.79, range=0..10))  # -> out, a, s, f, r, rs; inputs z: Int32, a: Point3d
# ---------- open_pit_mine_13: Python ----------
__author__ = "Sculpture"
__version__ = "2023.06.28"

import Rhino.Geometry as rg
import rhinoscriptsyntax as rs
import random

# Inputs
radius = x  # Radius of the mine
depth = y  # Depth of the mine
steps = z  # Number of steps or terraces
center_point_input = a  # Position of the mine
offset_distance = d  # Offset distance for creating steps
road_width = rw  # Width of the roads

# Generate mine
def generate_mine(radius, depth, steps, center_point_input, offset_distance, road_width):
    # list to hold all terraces
    terraces = []
    
    # list to hold lofted surfaces
    surfaces = []
    
    # list to hold flat surfaces
    flat_surfaces = []
    
    # list to hold the roads
    roads = []
    
    # list to hold the road surfaces
    road_surfaces = []

    # calculate depth of each step
    step_depth = depth/steps
    
    # Convert the input into a valid 3D point
    center_point = rs.coerce3dpoint(center_point_input)
    if center_point is None:
        center_point = rg.Point3d(0, 0, 0)  # default to origin if input is invalid

    # calculate the smallest radius
    smallest_radius = radius/steps
    
    # ensure offset_distance is smaller than the smallest radius
    if offset_distance >= smallest_radius:
        print("Offset distance is too large, reducing it to half the smallest radius")
        offset_distance = smallest_radius / 2
    
    for i in range(steps):
        # calculate current step's radius
        curr_radius = radius*(i+1)/steps
        
        # calculate current step's depth
        curr_depth = step_depth*i
        
        # create a plane at the current depth
        curr_plane = rg.Plane(center_point + rg.Vector3d.ZAxis*(-curr_depth), rg.Vector3d.ZAxis)
        
        # create a circle at the current plane with the current radius
        curr_circle = rg.Circle(curr_plane, curr_radius)
        
        # create offset curve
        offset_curves = curr_circle.ToNurbsCurve().Offset(rg.Plane.WorldXY, -offset_distance, rs.UnitAbsoluteTolerance(), rg.CurveOffsetCornerStyle.Sharp)
        
        # check if the offset operation was successful
        if offset_curves is None:
            print("Failed to offset curve at step {}".format(i))
        else:
            # add the circle and offset curve to the terraces list as separate elements
            terraces.append(curr_circle.ToNurbsCurve())
            terraces.append(offset_curves[0])
            
            # create planar surface between terrace and its offset curve
            loft_result = rg.Brep.CreateFromLoft([curr_circle.ToNurbsCurve(), offset_curves[0]], rg.Point3d.Unset, rg.Point3d.Unset, rg.LoftType.Normal, False)
            if loft_result is not None and len(loft_result) > 0:
                flat_surfaces.extend(loft_result)
            
            # if it's not the first step, loft the current and previous curves to create a surface
            if i > 0:
                prev_terrace = terraces[-3]  # get the previous terrace curve
                curr_terrace = terraces[-2]  # get the current terrace curve
                loft_results = rg.Brep.CreateFromLoft([prev_terrace, curr_terrace], rg.Point3d.Unset, rg.Point3d.Unset, rg.LoftType.Normal, False)
                if loft_results is not None and len(loft_results) > 0:
                    surfaces.extend(loft_results)
                    
                # create a road between this terrace and the previous one
                t0 = random.uniform(0, 1)
                t1 = random.uniform(0, 1)
                road_start = prev_terrace.PointAt(t0)  # Get a random point on the previous terrace
                road_end = curr_terrace.PointAt(t1)  # Get a random point on the current terrace
                
                # generate points between the start and end of the road
                road_points = [road_start]
                for j in range(1, 10):  # 10 points are used here, but this can be adjusted
                    interp_point = rg.Point3d((1 - j / 10) * road_start.X + j / 10 * road_end.X,
                                              (1 - j / 10) * road_start.Y + j / 10 * road_end.Y,
                                              (1 - j / 10) * road_start.Z + j / 10 * road_end.Z)
                    road_points.append(interp_point)
                road_points.append(road_end)
                
                # create the road curve
                road = rg.Curve.CreateInterpolatedCurve(road_points, 3)
                roads.append(road)
                
                # offset road curve in both directions
                offset_road_pos = road.Offset(rg.Plane.WorldXY, road_width, rs.UnitAbsoluteTolerance(), rg.CurveOffsetCornerStyle.Sharp)
                offset_road_neg = road.Offset(rg.Plane.WorldXY, -road_width, rs.UnitAbsoluteTolerance(), rg.CurveOffsetCornerStyle.Sharp)
                
                # check if offset operation was successful and create road surface by lofting
                if offset_road_pos is not None and offset_road_neg is not None:
                    for offset_road in [offset_road_pos[0], offset_road_neg[0]]:
                        road_surface = rg.Brep.CreateFromLoft([road, offset_road], rg.Point3d.Unset, rg.Point3d.Unset, rg.LoftType.Normal, False)
                        if road_surface is not None and len(road_surface) > 0:
                            road_surfaces.extend(road_surface)
    
    return terraces, surfaces, flat_surfaces, roads, road_surfaces

mine, surfaces, flats, roads, road_surfaces = generate_mine(radius, depth, steps, center_point_input, offset_distance, road_width)

# Outputs
a = mine
s = surfaces
f = flats
r = roads
rs = road_surfaces
# ---------- end open_pit_mine_13 ----------
geometry_40 = Geometry(open_pit_mine_13.r)
geometry_41 = Geometry(open_pit_mine_13.f)
geometry_42 = Geometry(open_pit_mine_13.a)
geometry_43 = Geometry(open_pit_mine_13.s)
geometry_44 = Geometry(open_pit_mine_13.rs)
panel_13 = Panel(open_pit_mine_13.out)
