# Grasshopper definition Strip_Mine_Excavator_001.gh (Grasshopper 1.0.7)

# ---- group: Main Body
bodylength = Slider(12.7, range=0..100)
bodywidth = Slider(20.9, range=0..100)
bodyheight = Slider(8.3, range=0..100)

# ---- group: Arm
armlength = Slider(34.3, range=0..100)
armwidth = Slider(1.6, range=0..100)
armheight = Slider(2, range=0..100)

# ---- group: Bucket
bucketradius = Slider(5.1, range=0..100)
bucketheight = Slider(10.1, range=0..100)

# ---- group: Main Body
bodylength_2 = Slider(12.7, range=0..100)
bodywidth_2 = Slider(20.9, range=0..100)
bodyheight_2 = Slider(8.3, range=0..100)

# ---- group: Arm
armlength_2 = Slider(33.7, range=0..100)
armwidth_2 = Slider(7.7, range=0..100)
armheight_2 = Slider(2, range=0..100)

# ---- group: Bucket
bucketradius_2 = Slider(1.9, range=0..100)
bucketheight_2 = Slider(4.9, range=0..100)

# ----
armangle = Slider(57.3, range=-100..101)

# ---- group: Arm
armheight_3 = Slider(2, range=0..100)
armlength_3 = Slider(40.7, range=0..100)
armwidth_3 = Slider(22.6, range=0..100)

# ---- group: Bucket
bucketheight_3 = Slider(4.9, range=0..100)
bucketradius_3 = Slider(1.9, range=0..100)

# ---- group: Main Body
bodylength_3 = Slider(12.7, range=0..100)
bodywidth_3 = Slider(20.9, range=0..100)
bodyheight_3 = Slider(8.3, range=0..100)

# ----
armangle_2 = Slider(33.3, range=-100..101)

# ---- group: Angle and Length
armangle_3 = Slider(38.2, range=-100..101)
hang_rope = Slider(16.3, range=0..101)

# ---- group: Main Body
bodylength_4 = Slider(20.6, range=0..100)
bodywidth_4 = Slider(7.4, range=0..100)
bodyheight_4 = Slider(8.3, range=0..100)

# ---- group: Arm
armlength_4 = Slider(35.5, range=0..100)
armheight_4 = Slider(2.5, range=0..100)
armwidth_4 = Slider(1.1, range=0..100)

# ---- group: Bucket
bucketradius_4 = Slider(7.1, range=0..100)
bucketheight_4 = Slider(2.9, range=0..100)

# ---- group: Arm
armheight_5 = Slider(2, range=0..100)
armlength_5 = Slider(40.7, range=0..100)
armwidth_5 = Slider(22.6, range=0..100)

# ---- group: Bucket
bucketheight_5 = Slider(4.9, range=0..100)
bucketradius_5 = Slider(1.9, range=0..100)

# ---- group: Main Body
bodylength_5 = Slider(12.7, range=0..100)
bodywidth_5 = Slider(20.9, range=0..100)
bodyheight_5 = Slider(8.3, range=0..100)

# ----
armangle_4 = Slider(53.4, range=-100..101)
drag_rope = Slider(23.4, range=0..101)
# GPT IS MY COLLEGE,
# summer school 2023
# Learn Grasshopper for Rhino3d from Wickerson Studios
# URBAN ENGINEERING
# Infrastucture and Technology in Modern Landscape
# 
# CONVENIENTLY DOWNLOAD ALL REPOITORIES
# On Sale
# $9.99
# https://lnkd.in/gxAyuQ7W
# www.wickersonstudios.com
# 
# #technology #engineering #school
# STRIP MINE EXCAVATOR
number_slider = Slider(20, range=0..100)
number_slider_2 = Slider(10, range=0..100)
number_slider_3 = Slider(10, range=0..100)
strip_mine_excavator = GhPythonScript(armAngle=armangle_2)  # -> out, a, b, c
# ---------- strip_mine_excavator: Python ----------
__author__ = "Sculpture"
__version__ = "2023.06.29"

import Rhino.Geometry as rg
import math

def RunScript(bodyLength, bodyWidth, bodyHeight, armLength, armDiameter, armAngle, bodyLift):
    # Create a Brep for the main body of the excavator
    body = rg.Box(rg.Plane.WorldXY, rg.Interval(-bodyLength / 2, bodyLength / 2), rg.Interval(-bodyWidth / 2, bodyWidth / 2), rg.Interval(0, bodyHeight)).ToBrep()

    # Calculate centroid of the main body and lift it up along the Z-axis
    bodyCentroid = rg.AreaMassProperties.Compute(body).Centroid
    bodyCentroid.Z += bodyLift

    # Create a cylinder for the arm of the excavator
    armStartPoint = rg.Point3d(bodyLength / 2, 0, bodyHeight)
    armDirection = rg.Vector3d.ZAxis
    armDirection.Rotate(math.radians(armAngle), rg.Vector3d.YAxis)
    armCylinder = rg.Cylinder(rg.Circle(rg.Plane(armStartPoint, armDirection), armDiameter / 2), armLength)
    arm = rg.Brep.CreateFromCylinder(armCylinder, True, True)  # Caps added

    # Calculate endpoint of the arm
    armEndPoint = armStartPoint + armDirection * armLength

    # Create a line for the hoist rope
    hoistRope = rg.Line(bodyCentroid, armEndPoint)

    return body, arm, hoistRope

# These parameters are meant to be connected to Grasshopper components
bodyLength = 20.0
bodyWidth = 10.0
bodyHeight = 10.0
armLength = 30.0
armDiameter = 2.0
armAngle = armAngle  # Angle of the arm relative to the XZ plane, in degrees
bodyLift = 5.0  # Amount to lift the centroid of the main body along the Z-axis

a, b, c = RunScript(bodyLength, bodyWidth, bodyHeight, armLength, armDiameter, armAngle, bodyLift)
# ---------- end strip_mine_excavator ----------
strip_mine_excavator_2 = GhPythonScript(armAngle=armangle_4, Hang_Rope=drag_rope)  # -> out, a, b, c, d, e
# ---------- strip_mine_excavator_2: Python ----------
__author__ = "Sculpture"
__version__ = "2023.06.29"

import Rhino.Geometry as rg
import math

def RunScript(bodyLength, bodyWidth, bodyHeight, armLength, armDiameter, armAngle, bodyLift, bucketHeight, bucketRadius, bucketRopeLength):
    # Create a Brep for the main body of the excavator
    body = rg.Box(rg.Plane.WorldXY, rg.Interval(-bodyLength / 2, bodyLength / 2), rg.Interval(-bodyWidth / 2, bodyWidth / 2), rg.Interval(0, bodyHeight)).ToBrep()

    # Calculate centroid of the main body and lift it up along the Z-axis
    bodyCentroid = rg.AreaMassProperties.Compute(body).Centroid
    bodyCentroid.Z += bodyLift

    # Create a cylinder for the arm of the excavator
    armStartPoint = rg.Point3d(bodyLength / 2, 0, bodyHeight)
    armDirection = rg.Vector3d.ZAxis
    armDirection.Rotate(math.radians(armAngle), rg.Vector3d.YAxis)
    armCylinder = rg.Cylinder(rg.Circle(rg.Plane(armStartPoint, armDirection), armDiameter / 2), armLength)
    arm = rg.Brep.CreateFromCylinder(armCylinder, True, True)  # Caps added

    # Calculate endpoint of the arm
    armEndPoint = armStartPoint + armDirection * armLength

    # Create a line for the hoist rope
    hoistRope = rg.Line(bodyCentroid, armEndPoint)

    # Create a line for the bucket rope
    bucketRopeStartPoint = armEndPoint
    bucketRopeEndPoint = bucketRopeStartPoint + rg.Vector3d(0, 0, -bucketRopeLength)
    bucketRope = rg.Line(bucketRopeStartPoint, bucketRopeEndPoint)

    # Create a cone for the bucket
    bucketBasePlane = rg.Plane(bucketRopeEndPoint, -armDirection)  # Plane with normal pointing towards the main body
    bucketCone = rg.Cone(bucketBasePlane, bucketHeight, bucketRadius)
    bucket = rg.Brep.CreateFromCone(bucketCone, True)

    return body, arm, hoistRope, bucketRope, bucket

# These parameters are meant to be connected to Grasshopper components
bodyLength = 20.0
bodyWidth = 10.0
bodyHeight = 10.0
armLength = 30.0
armDiameter = 2.0
#armAngle = 45.0  # Angle of the arm relative to the XZ plane, in degrees
bodyLift = 5.0  # Amount to lift the centroid of the main body along the Z-axis
bucketHeight = 5.0  # Height of the bucket
bucketRadius = 2.5  # Radius of the bucket
bucketRopeLength = Hang_Rope  # Length of the bucket rope

a, b, c, d, e = RunScript(bodyLength, bodyWidth, bodyHeight, armLength, armDiameter, armAngle, bodyLift, bucketHeight, bucketRadius, bucketRopeLength)
# ---------- end strip_mine_excavator_2 ----------
strip_mine_excavator_3 = GhPythonScript(
    x=bodylength_2,
    y=bodywidth_2,
    z=bodyheight_2,
    u=armlength_2,
    v=armwidth_2,
    w=armheight_2,
    s=bucketradius_2,
    t=bucketheight_2,
    armAngle=armangle)  # -> out, a
# ---------- strip_mine_excavator_3: Python ----------
__author__ = "Sculpture"
__version__ = "2023.06.29"

import Rhino.Geometry as rg
import math

def RunScript(bodyLength, bodyWidth, bodyHeight, armLength, bucketRadius, bucketHeight, armAngle):
    # Create a Brep for the main body of the excavator
    body = rg.Box(rg.Plane.WorldXY, rg.Interval(-bodyLength / 2, bodyLength / 2), rg.Interval(-bodyWidth / 2, bodyWidth / 2), rg.Interval(0, bodyHeight)).ToBrep()

    # Create a LineCurve for the arm of the excavator
    armStartPoint = rg.Point3d(0, 0, bodyHeight)
    armEndPoint = rg.Point3d(0, armLength * math.sin(math.radians(armAngle)), bodyHeight + armLength * math.cos(math.radians(armAngle)))
    arm = rg.LineCurve(armStartPoint, armEndPoint)

    # Create a Brep for the bucket of the excavator
    bucketStartPoint = armEndPoint
    bucketPlane = rg.Plane(bucketStartPoint, -arm.TangentAt(1))
    bucketCone = rg.Cone(bucketPlane, bucketHeight, bucketRadius)  # inverted the cone
    bucket = bucketCone.ToBrep(True)

    # Create lines for the hoist rope and the drag rope
    hoistRope = rg.LineCurve(armStartPoint, armEndPoint)
    dragRope = rg.LineCurve(armEndPoint, rg.Point3d(0, -armLength * math.sin(math.radians(armAngle)), bodyHeight))

    # Combine all the components into a single list
    model = [body, arm, bucket, hoistRope, dragRope]

    return model




# These parameters are meant to be connected to Grasshopper components
bodyLength = x
bodyWidth = y
bodyHeight = z
armLength = u
armWidth = v
armHeight = w
bucketRadius = s
bucketHeight = t
armAngle = armAngle  # Angle of the arm relative to the ground, in degrees


a = RunScript(bodyLength, bodyWidth, bodyHeight, armLength, bucketRadius, bucketHeight, armAngle)
# ---------- end strip_mine_excavator_3 ----------
strip_mine_excavator_4 = GhPythonScript(
    armAngle=armangle_3,
    Hang_Rope=hang_rope,
    x=bodylength_4,
    y=bodywidth_4,
    z=bodyheight_4,
    u=armlength_4,
    v=armwidth_4,
    w=armheight_4,
    s=bucketradius_4,
    t=bucketheight_4)  # -> out, a, b, c, d, e, f
# ---------- strip_mine_excavator_4: Python ----------
__author__ = "Sculpture"
__version__ = "2023.06.29"

import Rhino.Geometry as rg
import math

def RunScript(bodyLength, bodyWidth, bodyHeight, armLength, armDiameter, armAngle, bodyLift, bucketHeight, bucketRadius, bucketRopeLength):
    # Create a Brep for the main body of the excavator
    body = rg.Box(rg.Plane.WorldXY, rg.Interval(-bodyLength / 2, bodyLength / 2), rg.Interval(-bodyWidth / 2, bodyWidth / 2), rg.Interval(0, bodyHeight)).ToBrep()

    # Calculate centroid of the main body and lift it up along the Z-axis
    bodyCentroid = rg.AreaMassProperties.Compute(body).Centroid
    bodyCentroid.Z += bodyLift

    # Create a cylinder for the arm of the excavator
    armStartPoint = rg.Point3d(bodyLength / 2, 0, bodyHeight)
    armDirection = rg.Vector3d.ZAxis
    armDirection.Rotate(math.radians(armAngle), rg.Vector3d.YAxis)
    armCylinder = rg.Cylinder(rg.Circle(rg.Plane(armStartPoint, armDirection), armDiameter / 2), armLength)
    arm = rg.Brep.CreateFromCylinder(armCylinder, True, True)  # Caps added

    # Calculate endpoint of the arm
    armEndPoint = armStartPoint + armDirection * armLength

    # Create a line for the hoist rope
    hoistRope = rg.Line(bodyCentroid, armEndPoint)

    # Create a line for the bucket rope
    bucketRopeStartPoint = armEndPoint
    bucketRopeEndPoint = bucketRopeStartPoint + rg.Vector3d(0, 0, -bucketRopeLength)
    bucketRope = rg.Line(bucketRopeStartPoint, bucketRopeEndPoint)

    # Create a cone for the bucket
    bucketBasePlane = rg.Plane(bucketRopeEndPoint, -armDirection)  # Plane with normal pointing towards the main body
    bucketCone = rg.Cone(bucketBasePlane, bucketHeight, bucketRadius)
    bucket = rg.Brep.CreateFromCone(bucketCone, True)  # Bucket capped

    # Calculate centroid of the bucket
    bucketCentroid = rg.VolumeMassProperties.Compute(bucket).Centroid

    # Create a line for the drag rope
    dragRope = rg.Line(bucketCentroid, bodyCentroid)

    return body, arm, hoistRope, bucketRope, bucket, dragRope

# These parameters are meant to be connected to Grasshopper components
bodyLength = x
bodyWidth = y
bodyHeight = z
armLength = u
armDiameter = v
armAngle = armAngle  # Angle of the arm relative to the XZ plane, in degrees
bodyLift = w  # Amount to lift the centroid of the main body along the Z-axis
bucketHeight = s  # Height of the bucket
bucketRadius = t  # Radius of the bucket
bucketRopeLength = Hang_Rope  # Length of the bucket rope

a, b, c, d, e, f = RunScript(bodyLength, bodyWidth, bodyHeight, armLength, armDiameter, armAngle, bodyLift, bucketHeight, bucketRadius, bucketRopeLength)
# ---------- end strip_mine_excavator_4 ----------
strip_mine_excavator_5 = GhPythonScript(x=bodylength, y=bodywidth, z=bodyheight, u=armlength, v=armwidth, w=armheight, s=bucketradius, t=bucketheight)  # -> out, a
# ---------- strip_mine_excavator_5: Python ----------
__author__ = "Sculpture"
__version__ = "2023.06.29"

import Rhino.Geometry as rg

# All the input parameters will be passed as arguments to the function. The input parameters will match with the Grasshopper user interface
def RunScript(bodyLength, bodyWidth, bodyHeight, armLength, armWidth, armHeight, bucketRadius, bucketHeight):
    # Create a Brep for the main body of the excavator
    body = rg.Box(rg.Plane.WorldXY, rg.Interval(-bodyLength / 2, bodyLength / 2), rg.Interval(-bodyWidth / 2, bodyWidth / 2), rg.Interval(0, bodyHeight)).ToBrep()

    # Create a Brep for the arm of the excavator
    armStartPoint = rg.Point3d(0, 0, bodyHeight)
    armPlane = rg.Plane(armStartPoint, rg.Vector3d.YAxis)
    arm = rg.Box(armPlane, rg.Interval(0, armLength), rg.Interval(-armWidth / 2, armWidth / 2), rg.Interval(-armHeight / 2, armHeight / 2)).ToBrep()

    # Create a Brep for the bucket of the excavator
    bucketStartPoint = rg.Point3d(0, armLength, bodyHeight)
    bucketPlane = rg.Plane(bucketStartPoint, rg.Vector3d.YAxis)
    bucketCone = rg.Cone(bucketPlane, -bucketHeight, bucketRadius)  # inverted the cone
    bucket = bucketCone.ToBrep(True)

    # Combine all the components into a single list
    model = [body, arm, bucket]

    return model

# These parameters are meant to be connected to Grasshopper components
bodyLength = x
bodyWidth = y
bodyHeight = z
armLength = u
armWidth = v
armHeight = w
bucketRadius = s
bucketHeight = t

a = RunScript(bodyLength, bodyWidth, bodyHeight, armLength, armWidth, armHeight, bucketRadius, bucketHeight)
# ---------- end strip_mine_excavator_5 ----------
ghpython_script = GhPythonScript()  # -> out, a
# ---------- ghpython_script: Python ----------
__author__ = "Sculpture"
__version__ = "2023.06.29"

import Rhino.Geometry as rg

def RunScript():
    # Create a Brep for the main body of the excavator
    bodyLength = 20.0
    bodyWidth = 10.0
    bodyHeight = 10.0
    body = rg.Box(rg.Plane.WorldXY, rg.Interval(-bodyLength / 2, bodyLength / 2), rg.Interval(-bodyWidth / 2, bodyWidth / 2), rg.Interval(0, bodyHeight)).ToBrep()

    # Create a Brep for the arm of the excavator
    armLength = 30.0
    armWidth = 2.0
    armHeight = 2.0
    armStartPoint = rg.Point3d(bodyLength / 2, 0, bodyHeight)
    armPlane = rg.Plane(armStartPoint, rg.Vector3d.XAxis)
    arm = rg.Box(armPlane, rg.Interval(0, armLength), rg.Interval(-armWidth / 2, armWidth / 2), rg.Interval(-armHeight / 2, armHeight / 2)).ToBrep()

    # Create a Brep for the bucket of the excavator
    bucketRadius = 3.0
    bucketHeight = 6.0
    bucketStartPoint = rg.Point3d(bodyLength / 2 + armLength, 0, armStartPoint.Z - armHeight / 2)
    bucketPlane = rg.Plane(bucketStartPoint, rg.Vector3d.XAxis)
    bucketCone = rg.Cone(bucketPlane, bucketHeight, bucketRadius)
    bucket = bucketCone.ToBrep(True)

    # Combine all the components into a single list
    model = [body, arm, bucket]
    
    return model

a = RunScript()
# ---------- end ghpython_script ----------
panel = Panel(strip_mine_excavator_5.out)
panel_2 = Panel(strip_mine_excavator_3.out)
panel_3 = Panel(strip_mine_excavator.out)
geometry = Geometry(strip_mine_excavator_5.a)
geometry_2 = Geometry(strip_mine_excavator_4.a)
geometry_3 = Geometry(strip_mine_excavator_4.b)
geometry_4 = Geometry(strip_mine_excavator_4.c)
geometry_5 = Geometry(strip_mine_excavator_4.d)
geometry_6 = Geometry(strip_mine_excavator_4.e)
geometry_7 = Geometry(strip_mine_excavator_4.f)
geometry_8 = Geometry(strip_mine_excavator_3.a)
geometry_9 = Geometry(strip_mine_excavator.a)
geometry_10 = Geometry(strip_mine_excavator.b)
panel_4 = Panel(ghpython_script.out)
geometry_11 = Geometry(strip_mine_excavator.c)
geometry_12 = Geometry(ghpython_script.a)
geometry_13 = Geometry(strip_mine_excavator_2.a)
geometry_14 = Geometry(strip_mine_excavator_2.b)
geometry_15 = Geometry(strip_mine_excavator_2.c)
geometry_16 = Geometry(strip_mine_excavator_2.d)
geometry_17 = Geometry(strip_mine_excavator_2.e)
panel_5 = Panel(strip_mine_excavator_4.out)
panel_6 = Panel(strip_mine_excavator_2.out)
