# Grasshopper definition Slope_Mine_001.gh (Grasshopper 1.0.7)

min_tunnel_length = Slider(75.413, range=0..100)
max_tunnel_width = Slider(12.623, range=0..20)
min_tunnel_width = Slider(4.875, range=0..20)
tunnel_height = Slider(10.514, range=0..20)
max_tunnel_length = Slider(100, range=0..100)
max_depth = Slider(6, range=0..10)
vertical_tunnel_chance = Slider(0.5, range=0..1)
branch_angle = Slider(1.769, range=0..10)
# GPT IS MY COLLEGE,
# summer school 2023
# Learn Grasshopper for Rhino3d from Wickerson Studios
# URBAN ENGINEERING
# Infrastucture and Technology in Modern Landscape
# 
# CONVENIENTLY DOWNLOAD ALL REPOITORIES
# On Sale
# $9.99
# https://lnkd.in/gxAyuQ7W
# www.wickersonstudios.com
# 
# #technology #engineering #school
# DRIFT MINING
ghpython_script = GhPythonScript()  # -> out, a
# ---------- ghpython_script: Python ----------
__author__ = "Sculpture"
__version__ = "2023.06.30"

import rhinoscriptsyntax as rs
import Rhino.Geometry as rg

# Parameters for the drift mine
tunnel_length = 100 # units
tunnel_radius = 10 # units

# The start point of the tunnel
start_point = rg.Point3d(0, 0, 0)

# The end point of the tunnel, based on the tunnel length
end_point = rg.Point3d(0, 0, -tunnel_length)

# Create a base circle for the tunnel at the start_point
base_circle = rg.Circle(start_point, tunnel_radius)

# Create the tunnel as a cylinder
tunnel_cylinder = rg.Cylinder(base_circle, tunnel_length)
tunnel = tunnel_cylinder.ToNurbsSurface()

# Output the tunnel to Grasshopper
a = tunnel
# ---------- end ghpython_script ----------
drift_mining = GhPythonScript()  # -> out, a, b, c
# ---------- drift_mining: Python ----------
__author__ = "Sculpture"
__version__ = "2023.06.30"

import Rhino.Geometry as rg

# Parameters for the drift mine
main_tunnel_length = 100 # units
branch_tunnel_length = 50 # units
tunnel_width = 10 # units
tunnel_height = 10 # units

# The start point of the main tunnel
main_start_point = rg.Point3d(0, 0, 0)

# The direction and length of the main tunnel
main_direction = rg.Vector3d(0, 0, -main_tunnel_length)

# Create the main tunnel
main_base_rectangle = rg.Rectangle3d(rg.Plane.WorldXY, rg.Interval(-tunnel_width/2, tunnel_width/2), rg.Interval(0, main_tunnel_length))
main_tunnel = rg.Extrusion.Create(main_base_rectangle.ToNurbsCurve(), tunnel_height, True)

# Define the start points of the branch tunnels
branch1_start_point = rg.Point3d(0, 0, -main_tunnel_length / 2)
branch2_start_point = rg.Point3d(0, 0, -main_tunnel_length / 2)

# Define the direction and length of the branch tunnels
branch1_direction = rg.Vector3d(main_tunnel_length / 2, 0, 0)
branch2_direction = rg.Vector3d(-main_tunnel_length / 2, 0, 0)

# Create the branch tunnels
branch1_base_rectangle = rg.Rectangle3d(rg.Plane(branch1_start_point, rg.Vector3d.XAxis), rg.Interval(-tunnel_width/2, tunnel_width/2), rg.Interval(0, branch_tunnel_length))
branch1_tunnel = rg.Extrusion.Create(branch1_base_rectangle.ToNurbsCurve(), tunnel_height, True)

branch2_base_rectangle = rg.Rectangle3d(rg.Plane(branch2_start_point, -rg.Vector3d.XAxis), rg.Interval(-tunnel_width/2, tunnel_width/2), rg.Interval(0, branch_tunnel_length))
branch2_tunnel = rg.Extrusion.Create(branch2_base_rectangle.ToNurbsCurve(), tunnel_height, True)

# Output the tunnels to Grasshopper
a = main_tunnel
b = branch1_tunnel
c = branch2_tunnel
# ---------- end drift_mining ----------
drift_mining_2 = GhPythonScript()  # -> out, a
# ---------- drift_mining_2: Python ----------
__author__ = "Sculpture"
__version__ = "2023.06.30"

import Rhino.Geometry as rg
import math
import random

# Parameters for the drift mine
max_tunnel_length = 100 # units
min_tunnel_length = 50 # units
max_tunnel_width = 10 # units
min_tunnel_width = 5 # units
tunnel_height = 10 # units
max_depth = 5 # increased maximum depth for more tunnels
branch_angle = math.pi / 6 # smaller angle for more branches
vertical_tunnel_chance = 0.5 # 50% chance of a vertical tunnel

def create_tunnel(start_point, direction, width, length, depth, existing_tunnels=[]):
    # Create the tunnel
    base_rectangle = rg.Rectangle3d(rg.Plane(start_point, direction), rg.Interval(-width/2, width/2), rg.Interval(0, length))
    tunnel = rg.Extrusion.Create(base_rectangle.ToNurbsCurve(), tunnel_height, True)

    # Add the new tunnel to the list of existing tunnels
    existing_tunnels = existing_tunnels + [tunnel]

    # Stop the recursion if the maximum depth is reached
    if depth >= max_depth:
        return existing_tunnels

    # Calculate the start point and direction of the branch tunnels
    branch_start_point = start_point + direction * length

    # Create copies of the direction vector and rotate them
    branch1_direction = rg.Vector3d(direction)
    branch1_direction.Rotate(branch_angle, rg.Vector3d.ZAxis)
    branch2_direction = rg.Vector3d(direction)
    branch2_direction.Rotate(-branch_angle, rg.Vector3d.ZAxis)

    # Randomize the width and length of the branch tunnels
    branch_width = random.uniform(min_tunnel_width, max_tunnel_width)
    branch_length = random.uniform(min_tunnel_length, max_tunnel_length)

    # Recursively create the branch tunnels
    existing_tunnels = create_tunnel(branch_start_point, branch1_direction, branch_width, branch_length, depth + 1, existing_tunnels)
    existing_tunnels = create_tunnel(branch_start_point, branch2_direction, branch_width, branch_length, depth + 1, existing_tunnels)

    # Create a vertical tunnel with a certain probability
    if random.random() < vertical_tunnel_chance:
        vertical_start_point = start_point + direction * length
        vertical_direction = rg.Vector3d(0, 0, 1 if random.random() < 0.5 else -1)
        vertical_width = random.uniform(min_tunnel_width, max_tunnel_width)
        vertical_length = random.uniform(min_tunnel_length, max_tunnel_length)
        existing_tunnels = create_tunnel(vertical_start_point, vertical_direction, vertical_width, vertical_length, depth + 1, existing_tunnels)

    # Return the list of tunnels
    return existing_tunnels

# The start point and direction of the main tunnel
start_point = rg.Point3d(0, 0, 0)
direction = rg.Vector3d(1, 0, 0)

# Randomize the width and length of the main tunnel
tunnel_width = random.uniform(min_tunnel_width, max_tunnel_width)
tunnel_length = random.uniform(min_tunnel_length, max_tunnel_length)

# Create the main tunnel and its branches
tunnels = create_tunnel(start_point, direction, tunnel_width, tunnel_length, 0)

# Output the tunnels to Grasshopper
a = tunnels
# ---------- end drift_mining_2 ----------
drift_mining_3 = GhPythonScript(
    x=max_tunnel_length,
    y=min_tunnel_length,
    z=max_tunnel_width,
    u=min_tunnel_width,
    v=tunnel_height,
    w=max_depth,
    s=branch_angle,
    t=vertical_tunnel_chance)  # -> out, a; inputs w: Int32
# ---------- drift_mining_3: Python ----------
__author__ = "Sculpture"
__version__ = "2023.06.30"

import Rhino.Geometry as rg
import math
import random

# Parameters for the drift mine
max_tunnel_length = x # units
min_tunnel_length = y # units
max_tunnel_width = z # units
min_tunnel_width = u # units
tunnel_height = v # units
max_depth = w # increased maximum depth for more tunnels
branch_angle = math.pi / s # smaller angle for more branches
vertical_tunnel_chance = t # 50% chance of a vertical tunnel

def create_tunnel(start_point, direction, width, length, depth, existing_tunnels=[]):
    # Create the tunnel
    base_rectangle = rg.Rectangle3d(rg.Plane(start_point, direction), rg.Interval(-width/2, width/2), rg.Interval(0, length))
    tunnel = rg.Extrusion.Create(base_rectangle.ToNurbsCurve(), tunnel_height, True)

    # Add the new tunnel to the list of existing tunnels
    existing_tunnels = existing_tunnels + [tunnel]

    # Stop the recursion if the maximum depth is reached
    if depth >= max_depth:
        return existing_tunnels

    # Calculate the start point and direction of the branch tunnels
    branch_start_point = start_point + direction * length

    # Create copies of the direction vector and rotate them
    branch1_direction = rg.Vector3d(direction)
    branch1_direction.Rotate(branch_angle, rg.Vector3d.ZAxis)
    branch2_direction = rg.Vector3d(direction)
    branch2_direction.Rotate(-branch_angle, rg.Vector3d.ZAxis)

    # Randomize the width and length of the branch tunnels
    branch_width = random.uniform(min_tunnel_width, max_tunnel_width)
    branch_length = random.uniform(min_tunnel_length, max_tunnel_length)

    # Recursively create the branch tunnels
    existing_tunnels = create_tunnel(branch_start_point, branch1_direction, branch_width, branch_length, depth + 1, existing_tunnels)
    existing_tunnels = create_tunnel(branch_start_point, branch2_direction, branch_width, branch_length, depth + 1, existing_tunnels)

    # Create a vertical tunnel with a certain probability
    if random.random() < vertical_tunnel_chance:
        vertical_start_point = start_point + direction * length
        vertical_direction = rg.Vector3d(0, 0, 1 if random.random() < 0.5 else -1)
        vertical_width = random.uniform(min_tunnel_width, max_tunnel_width)
        vertical_length = random.uniform(min_tunnel_length, max_tunnel_length)
        existing_tunnels = create_tunnel(vertical_start_point, vertical_direction, vertical_width, vertical_length, depth + 1, existing_tunnels)

    # Return the list of tunnels
    return existing_tunnels

# The start point and direction of the main tunnel
start_point = rg.Point3d(0, 0, 0)
direction = rg.Vector3d(1, 0, 0)

# Randomize the width and length of the main tunnel
tunnel_width = random.uniform(min_tunnel_width, max_tunnel_width)
tunnel_length = random.uniform(min_tunnel_length, max_tunnel_length)

# Create the main tunnel and its branches
tunnels = create_tunnel(start_point, direction, tunnel_width, tunnel_length, 0)

# Output the tunnels to Grasshopper
a = tunnels
# ---------- end drift_mining_3 ----------
drift_mining_4 = GhPythonScript()  # -> out, a
# ---------- drift_mining_4: Python ----------
__author__ = "Sculpture"
__version__ = "2023.06.30"

import Rhino.Geometry as rg
import math
import random

# Parameters for the drift mine
max_tunnel_length = 100 # units
min_tunnel_length = 50 # units
max_tunnel_width = 10 # units
min_tunnel_width = 5 # units
tunnel_height = 10 # units
max_depth = 3
branch_angle = math.pi / 4 # angle in radians

def create_tunnel(start_point, direction, width, length, depth):
    # Create the tunnel
    base_rectangle = rg.Rectangle3d(rg.Plane(start_point, direction), rg.Interval(-width/2, width/2), rg.Interval(0, length))
    tunnel = rg.Extrusion.Create(base_rectangle.ToNurbsCurve(), tunnel_height, True)

    # Stop the recursion if the maximum depth is reached
    if depth >= max_depth:
        return [tunnel]

    # Calculate the start point and direction of the branch tunnels
    branch_start_point = start_point + direction * length
    
    # Create copies of the direction vector and rotate them
    branch1_direction = rg.Vector3d(direction)
    branch1_direction.Rotate(branch_angle, rg.Vector3d.ZAxis)
    
    branch2_direction = rg.Vector3d(direction)
    branch2_direction.Rotate(-branch_angle, rg.Vector3d.ZAxis)

    # Randomize the width and length of the branch tunnels
    branch_width = random.uniform(min_tunnel_width, max_tunnel_width)
    branch_length = random.uniform(min_tunnel_length, max_tunnel_length)

    # Recursively create the branch tunnels
    branch1_tunnels = create_tunnel(branch_start_point, branch1_direction, branch_width, branch_length, depth + 1)
    branch2_tunnels = create_tunnel(branch_start_point, branch2_direction, branch_width, branch_length, depth + 1)

    # Return the list of tunnels
    return [tunnel] + branch1_tunnels + branch2_tunnels

# The start point and direction of the main tunnel
start_point = rg.Point3d(0, 0, 0)
direction = rg.Vector3d(0, 0, -1)

# Randomize the width and length of the main tunnel
tunnel_width = random.uniform(min_tunnel_width, max_tunnel_width)
tunnel_length = random.uniform(min_tunnel_length, max_tunnel_length)

# Create the main tunnel and its branches
tunnels = create_tunnel(start_point, direction, tunnel_width, tunnel_length, 0)

# Output the tunnels to Grasshopper
a = tunnels
# ---------- end drift_mining_4 ----------
drift_mining_5 = GhPythonScript()  # -> out, a
# ---------- drift_mining_5: Python ----------
__author__ = "Sculpture"
__version__ = "2023.06.30"

import Rhino.Geometry as rg
import math
import random

# Parameters for the drift mine
max_tunnel_length = 100 # units
min_tunnel_length = 50 # units
max_tunnel_width = 10 # units
min_tunnel_width = 5 # units
tunnel_height = 10 # units
max_depth = 3
branch_angle = math.pi / 4 # angle in radians
vertical_tunnel_chance = 0.2 # Chance of a vertical tunnel being created at the end of each tunnel

def create_tunnel(start_point, direction, width, length, depth, existing_tunnels=[]):
    # Create the tunnel
    base_rectangle = rg.Rectangle3d(rg.Plane(start_point, direction), rg.Interval(-width/2, width/2), rg.Interval(0, length))
    tunnel = rg.Extrusion.Create(base_rectangle.ToNurbsCurve(), tunnel_height, True)

    # Check if the new tunnel intersects any existing tunnels
    overlapCurves = [] # list to store the intersection curves
    intersectionPoints = [] # list to store the intersection points
    for existing_tunnel in existing_tunnels:
        intersection, overlapCurves, intersectionPoints = rg.Intersect.Intersection.BrepBrep(existing_tunnel.ToBrep(), tunnel.ToBrep(), 0.1)
        if intersection:
            return []

    # Add the new tunnel to the list of existing tunnels
    existing_tunnels = existing_tunnels + [tunnel]

    # Create a vertical tunnel with a certain probability
    vertical_tunnels = []
    if random.random() < vertical_tunnel_chance:
        vertical_start_point = start_point + direction * length
        vertical_direction = rg.Vector3d(0, 0, 1 if random.random() < 0.5 else -1)
        vertical_width = random.uniform(min_tunnel_width, max_tunnel_width)
        vertical_length = random.uniform(min_tunnel_length, max_tunnel_length)
        vertical_tunnels = create_tunnel(vertical_start_point, vertical_direction, vertical_width, vertical_length, depth + 1, existing_tunnels)
        existing_tunnels = existing_tunnels + vertical_tunnels

    # Stop the recursion if the maximum depth is reached
    if depth >= max_depth:
        return [tunnel] + vertical_tunnels

    # Calculate the start point and direction of the branch tunnels
    branch_start_point = start_point + direction * length

    # Create copies of the direction vector and rotate them
    branch1_direction = rg.Vector3d(direction)
    branch1_direction.Rotate(branch_angle, rg.Vector3d.ZAxis)
    branch2_direction = rg.Vector3d(direction)
    branch2_direction.Rotate(-branch_angle, rg.Vector3d.ZAxis)

    # Randomize the width and length of the branch tunnels
    branch_width = random.uniform(min_tunnel_width, max_tunnel_width)
    branch_length = random.uniform(min_tunnel_length, max_tunnel_length)

    # Recursively create the branch tunnels
    branch1_tunnels = create_tunnel(branch_start_point, branch1_direction, branch_width, branch_length, depth + 1, existing_tunnels)
    branch2_tunnels = create_tunnel(branch_start_point, branch2_direction, branch_width, branch_length, depth + 1, existing_tunnels)

    # Return the list of tunnels
    return [tunnel] + vertical_tunnels + branch1_tunnels + branch2_tunnels

# The start point and direction of the main tunnel
start_point = rg.Point3d(0, 0, 0)
direction = rg.Vector3d(1, 0, 0)

# Randomize the width and length of the main tunnel
tunnel_width = random.uniform(min_tunnel_width, max_tunnel_width)
tunnel_length = random.uniform(min_tunnel_length, max_tunnel_length)

# Create the main tunnel and its branches
tunnels = create_tunnel(start_point, direction, tunnel_width, tunnel_length, 0)

# Output the tunnels to Grasshopper
a = tunnels
# ---------- end drift_mining_5 ----------
geometry = Geometry(ghpython_script.a)
geometry_2 = Geometry(drift_mining.a)
geometry_3 = Geometry(drift_mining.b)
geometry_4 = Geometry(drift_mining.c)
geometry_5 = Geometry(drift_mining_4.a)
geometry_6 = Geometry(drift_mining_2.a)
geometry_7 = Geometry(drift_mining_5.a)
geometry_8 = Geometry(drift_mining_3.a)
panel = Panel(drift_mining.out)
panel_2 = Panel(ghpython_script.out)
panel_3 = Panel(drift_mining_4.out)
panel_4 = Panel(drift_mining_2.out)
panel_5 = Panel(drift_mining_5.out)
panel_6 = Panel(drift_mining_3.out)
